# Grasshopper definition lesson2-4.gh (Grasshopper 1.0.7)
# plug-ins: ghgl

nurbs = NurbsCurve(
    Vertices=[Point(-10.49075103, 15.12745017, 0), Point(3.482505062, 12.93704693, 0), Point(9.473996025, -5.984742518, 0), Point(2.889320863, -15.40379492, 0), Point(-9.449265209, -27.12678482, 0), Point(-21.97314573, -7.71351532, 0), Point(-12.3538473, 0.6367463483, 0)],
    Degree=3,
    Periodic=False)  # -> Curve, Length, Domain
col = Colour(RGB(73, 139, 140))
divide = DivideCurve(Curve=nurbs.Curve, Count=Slider(45, range=1..500), Kinks=False)  # -> Points, Tangents, Parameters
remap = RemapNumbers(Value=divide.Parameters, Source=nurbs.Domain, Target=Domain(0, 1))  # -> Mapped, Clipped
gl_shader = GLShader(
    Vertex=divide.Points,
    Tangent=remap.Mapped,
    Vcolor=col,
    DrawMode=3,
    FragmentShader="""#version 330

in vec4 vertex_color;
void main()
{
  gl_FragColor = vertex_color;
}""",
    GLShader=(0, 1, 0),
    VertexShader="""#version 330

layout(location = 0) in vec3 vertex;
layout(location = 1) in vec4 vcolor;
layout(location = 2) in float t;
uniform mat4 _worldToClip;
uniform float _time;
out vec4 vertex_color;

void main() 
{
  float pos = t + (mod(_time,2)-0.5);
  if( abs(pos-0.5)<0.05 )
    vertex_color = vec4(1,0,0,1);
  else
    vertex_color = vcolor;
  gl_Position = _worldToClip * vec4(vertex,1);
}""",
    glLineWidth=3,
    glPointSize=8)
