# Grasshopper definition gradient_linear.gh (Grasshopper 1.0.7)
# plug-ins: ghgl

# Two Color Linear Gradient
circle = Circle([{Plane=Plane(origin=(0, 1, 0), x=(-0.7071067812, -0.7071067812, 0), y=(0.7071067812, -0.7071067812, 0)), Radius=7.071067812}, {Plane=Plane(origin=(-7, 3, 0), x=(-0.894427191, -0.4472135955, 0), y=(0.4472135955, -0.894427191, 0)), Radius=2.236067977}, {Plane=Plane(origin=(9, -3, 0), x=(-0.8, -0.6, 0), y=(0.6, -0.8, 0)), Radius=5}, {Plane=Plane(origin=(-5, -10, 0), x=(0.316227766, 0.9486832981, 0), y=(-0.9486832981, 0.316227766, 0)), Radius=6.32455532}])
pt = Point(Point(5.498335714, -11.29287386, 0))
pt_2 = Point(Point(-9.080958743, -1.473422751, 0))
runion = RegionUnion(Curves=circle)
boundary = BoundarySurfaces(Edges=runion)
# Code for prototyping / debugging
c_script = CSharpScript(lineStart=pt_2, lineEnd=pt, M=boundary)  # -> out, A; inputs lineStart: Point3d, lineEnd: Point3d, M: Mesh
# ---------- c_script: C# ----------
    var items = new List<float>(M.Vertices.Count);
    foreach(var vert in M.Vertices)
    {
      items.Add(ClosestPointToLineParameter(vert, (Point3f) lineStart, (Point3f) lineEnd));
    }
    A = items;
# ---------- c_script: C# additional code ----------
  // return normalized parameter for closest point to a line
  float ClosestPointToLineParameter(Point3f point, Point3f lineStart, Point3f lineEnd)
  {
    Vector3f direction = normalize(lineEnd - lineStart);
    Vector3f v = point - lineStart;
    float d = dot(direction, v);
    return d / length(lineEnd - lineStart);
  }

  Vector3f normalize(Vector3f v)
  {
    v.Unitize();
    return v;
  }

  float dot(Vector3f a, Vector3f b)
  {
    return a.X * b.X + a.Y * b.Y + a.Z * b.Z;
  }

  float length(Vector3f a)
  {
    return a.Length;
  }
# ---------- end c_script ----------
col = Colour(RGB(40, 236, 153))
col_2 = Colour(RGB(249, 110, 255))
panel = Panel(c_script.A)
linear_gradient = GLMeshShader(
    M=boundary,
    Point0=pt_2,
    Point1=pt,
    Color0=col,
    Color1=col_2,
    DepthTestingEnabled=True,
    DepthWritingEnabled=True,
    DrawMode=4,
    FragmentShader="""#version 330

uniform vec4 color0;
uniform vec4 color1;
in float lineT;
out vec4 final_pixel;

void main()
{
  float t = clamp(lineT, 0.0, 1.0);
  final_pixel =  mix(color0, color1, lineT);
}""",
    GLShader=(0, 2, 0),
    PreviewSortOrder=5,
    VertexShader="""#version 330

layout(location = 0) in vec3 _meshVertex;

uniform mat4 _worldToClip;
uniform vec3 point0;
uniform vec3 point1;

out float lineT;

// return normalized parameter for closest point to a line
float ClosestPointToLineParameter(in vec3 point, in vec3 lineStart, in vec3 lineEnd) {
  vec3 direction = normalize(lineEnd - lineStart);
  vec3 v = point - lineStart;
  float d = dot(direction, v);
  return d / length(lineEnd-lineStart);
}

void main() 
{
  lineT = ClosestPointToLineParameter(_meshVertex, point0, point1);
  gl_Position = _worldToClip * vec4(_meshVertex,1.0);
}""",
    glLineWidth=3,
    glPointSize=8)  # -> Color, Depth
