# Grasshopper definition post_effects(old_tv).gh (Grasshopper 1.0.7)
# plug-ins: ghgl

sl = Slider(1.122, range=0..2)
opacity = Slider(0.225, range=0..1)
noise = Slider(0.736, range=0..1)
quality = Slider(6.883, range=0..10)
bezel = Slider(0.105, range=0..1)
vmix = Slider(0.122, range=0..1)
static = BooleanToggle(False)
sepia = BooleanToggle(True)
pt = Point([Point(-1, -1, -1), Point(1, -1, -1), Point(1, 1, -1), Point(-1, 1, -1)])
gl_shader = GLShader(
    Vertex=pt,
    Vignette_mix=vmix,
    Scanline_density=sl,
    Scanline_opacity=opacity,
    Signal_quality=quality,
    Noise_amount=noise,
    Bezel_size=bezel,
    Show_me_static=static,
    Sepia_filter=sepia,
    DepthTestingEnabled=True,
    DepthWritingEnabled=True,
    DrawMode=6,
    FragmentShader="""/////////////////////////////////////////////////////////////////////
// Sepia Scanline post-effect for Rhino
// Robert McNeel & Associates (C) - 2019
#version 330

uniform sampler2D _colorBuffer;
uniform float _time;
uniform float vignette_mix;
uniform float scanline_density;
uniform float scanline_opacity;
uniform float noise_amount;
uniform float bezel_size;
uniform bool  show_me_static;
uniform float signal_quality;
uniform bool  sepia_filter;

vec2 bufferSize = textureSize(_colorBuffer, 0);

float random (vec2 st, vec2 hvs) { return fract(sin(dot(st.xy, hvs))*pow(10.0, signal_quality));}

/////////////////////////////////////////////////////////////////////
void scanLine(out vec4  fragColor, 
              in  vec2  fragCoord, 
              in  vec4  color, 
              in  vec2  uv, 
              in  float density, 
              in  float opac, 
              in  float noise)
{
  float lineSize = bufferSize.y * density;
  vec2 separation = vec2(sin(uv.y * lineSize), cos(uv.y * lineSize));
  vec3 horzNoise = (separation.rgr + vec3(random(uv*_time, vec2(0.0,1.0))) * noise);
  vec3 scanlines = horzNoise * opac;

  if (show_me_static)
    color.rgb = scanlines;
  else
    color.rgb = (color.rgb + (color.rgb * scanlines));
  
  fragColor = color;

  float dfc = distance(uv, vec2(0.5,0.5));
  float vignetteAmount = 1.0-dfc;
  vignetteAmount = smoothstep(vignette_mix, 1.0, vignetteAmount);

  float bezel      = pow(dfc, 1.0/(bezel_size));
  vec2  bezel_edge = uv + (uv * 16.0 - 8.0)*bezel;
  
  if (bezel_edge.x <= 0.0 || bezel_edge.y <= 0.0 || bezel_edge.x >= 1.0 || bezel_edge.y >= 1.0)
    fragColor = vec4(vec3(0.0), 1.0);
  else
    fragColor = vec4(color.rgb*vignetteAmount, 1.0);
}

/////////////////////////////////////////////////////////////////////
void ProcessImage(out vec4 fragColor, in vec2 fragCoord, in vec2 uv)
{
  vec4 fbColor = texture(_colorBuffer, uv, 0);
  scanLine(fragColor, fragCoord, fbColor, uv, 
           scanline_density, scanline_opacity, noise_amount);
  
  // Apply a sepia filter...
  if (sepia_filter)
    fragColor.rgb = vec3(dot(fragColor.rgb, vec3(0.393, 0.769, 0.189)),
                         dot(fragColor.rgb, vec3(0.349, 0.686, 0.168)),   
                         dot(fragColor.rgb, vec3(0.272, 0.534, 0.131)));
    
 }

/////////////////////////////////////////////////////////////////////
out vec4 FragColor;

void main()
{
  vec2 uv = gl_FragCoord.xy / bufferSize;
 
  ProcessImage(FragColor, gl_FragCoord.xy, uv);
}""",
    GLShader=(0, 1, 0),
    PreviewSortOrder=5,
    VertexShader="""#version 330

layout(location = 0) in vec3 vertex;
out vec2 tc;
void main() 
{
  gl_Position = vec4(vertex,1.0);
}""",
    glLineWidth=3,
    glPointSize=8)
