# Grasshopper definition post_effects(posterize).gh (Grasshopper 1.0.7)
# plug-ins: ghgl

gamma = Slider(1.132, range=0..5)
levels = Slider(2, range=0..64)
grayscale = BooleanToggle(False)
pt = Point([Point(-1, -1, -1), Point(1, -1, -1), Point(1, 1, -1), Point(-1, 1, -1)])
posterize = GLShader(
    Vertex=pt,
    Gamma=gamma,
    Levels=levels,
    Grayscale=grayscale,
    DepthTestingEnabled=True,
    DepthWritingEnabled=True,
    DrawMode=6,
    FragmentShader="""/////////////////////////////////////////////////////////////////////
// Image Posterize post-effect for Rhino
// Robert McNeel & Associates (C) - 2019
#version 330

const vec3 Luminance = vec3(0.2125, 0.7154, 0.0721);

// Rhino predefines...
uniform vec2      _viewportSize;
uniform sampler2D _colorBuffer;

// Shader inputs...
uniform float Gamma = 1.0;
uniform float Levels = 6.0;
uniform bool Grayscale = false;

///////////////////////////////////////////////////////////////
vec3 Posterize(vec3 color, float levels, bool grayscale)
{
  levels += 2.0;
  color = pow(color, vec3(Gamma));
  color = floor(color * levels)/levels;
  color = pow(color, vec3(1.0/Gamma));
  if (grayscale)
    color.rgb = vec3(dot(Luminance, color.rgb));
  return color.rgb;
}

///////////////////////////////////////////////////////////////
void processImage(inout vec4 fragColor, in vec2 fragCoord)
{
  vec2 uv = fragCoord/textureSize(_colorBuffer, 0);

  fragColor = texture(_colorBuffer, uv).rgba;
  fragColor.rgb = Posterize(fragColor.rgb, Levels, Grayscale);
  fragColor.a = 1.0;
}

///////////////////////////////////////////////////////////////
out vec4 fragColor;
void main()
{
  processImage(fragColor, gl_FragCoord.xy);
}""",
    GLShader=(0, 1, 0),
    PreviewSortOrder=5,
    VertexShader="""#version 330

layout(location = 0) in vec3 vertex;
out vec2 tc;
void main() 
{
  gl_Position = vec4(vertex,1.0);
}""",
    glLineWidth=3,
    glPointSize=8)
