# Grasshopper definition gradient_radial.gh (Grasshopper 1.0.7)
# plug-ins: ghgl

circle = Circle([{Plane=Plane(origin=(0, 1, 0), x=(-0.7071067812, -0.7071067812, 0), y=(0.7071067812, -0.7071067812, 0)), Radius=7.071067812}, {Plane=Plane(origin=(-7, 3, 0), x=(-0.894427191, -0.4472135955, 0), y=(0.4472135955, -0.894427191, 0)), Radius=2.236067977}, {Plane=Plane(origin=(9, -3, 0), x=(-0.8, -0.6, 0), y=(0.6, -0.8, 0)), Radius=5}, {Plane=Plane(origin=(-5, -10, 0), x=(0.316227766, 0.9486832981, 0), y=(-0.9486832981, 0.316227766, 0)), Radius=6.32455532}])
runion = RegionUnion(Curves=circle)
pt = Point(Point(0, 0, 0))
# Two Color Radial Gradient
pt_2 = Point(Point(16.00562845, -3.732603414, 0))
boundary = BoundarySurfaces(Edges=runion)
col = Colour(RGB(40, 236, 153))
col_2 = Colour(RGB(249, 110, 255))
radial_gradient = GLMeshShader(
    M=boundary,
    Point0=pt,
    Point1=pt_2,
    Color0=col,
    Color1=col_2,
    DepthTestingEnabled=True,
    DepthWritingEnabled=True,
    DrawMode=4,
    FragmentShader="""#version 330

uniform vec3 point0;
uniform vec3 point1;
uniform vec4 color0;
uniform vec4 color1;
in vec3 vertex;
out vec4 fragment_color;

void main()
{
  vec3 center = point0;
  float totalDistance = distance(point1,center);
  float distanceToCenter = distance(vertex,center);
  float t = distanceToCenter / totalDistance;

  t = clamp(t, 0.0, 1.0);
  vec4 color = mix(color0, color1, t);
  fragment_color = color;
}""",
    GLShader=(0, 1, 0),
    PreviewSortOrder=5,
    VertexShader="""#version 330

layout(location = 0) in vec3 _meshVertex;

uniform mat4 _worldToClip;

out vec3 vertex;

void main() 
{
  vertex = _meshVertex;
  gl_Position = _worldToClip * vec4(_meshVertex,1.0);
}""",
    glLineWidth=3,
    glPointSize=8)
