# Grasshopper definition billboard_01.gh (Grasshopper 1.0.7)
# plug-ins: ghgl

panel = Panel("""0
1
2
0
2
3""")
num = Number(panel)
pt = Point([Point(-7.653172522, -8.604730028, 0), Point(-7.092159532, 7.817760743, 0), Point(10.31744125, 10.8745758, 0), Point(11.81542902, -10.72284824, 0)])
lng = ListLength(List=pt)
dup = DuplicateData(Data=num, Number=lng, Order=True)
panel_2 = Panel(dup)
number_slider = Slider(10, range=1..100)
dup_2 = DuplicateData(Data=pt, Number=6, Order=False)
panel_3 = Panel("http://assets.stickpng.com/thumbs/5845e13e7733c3558233c0ec.png")
panel_4 = Panel(dup_2)
move = Move(Motion=Vector(3.226342935, -5.041160836, 0))  # -> Geometry, Transform
gl_shader = GLShader(
    Vertex=dup_2,
    Index=panel_2,
    Image=panel_3,
    Width=number_slider,
    Height=number_slider,
    Xform=move.Transform,
    DepthTestingEnabled=True,
    DepthWritingEnabled=True,
    DrawMode=4,
    FragmentShader="""#version 330

uniform sampler2D image;
in vec2 texture_coordinate;
out vec4 fragment_color;

void main() {
  fragment_color = texture(image, texture_coordinate);
  if (fragment_color.a < 0.1) {
    discard;
  }
}""",
    GLShader=(0, 2, 0),
    PreviewSortOrder=5,
    VertexShader="""#version 330

layout(location = 0) in vec3 vertex;
layout(location = 1) in float index;

uniform mat4 _worldToClip;
uniform mat4 _worldToCamera;
uniform mat4 _cameraToClip;
uniform mat4 xform;
uniform float width;
uniform float height;
out vec2 texture_coordinate;

void main() {
  int whichCorner = int(index);
  vec4 transformed = xform * vec4(vertex, 1.0);
  vec4 corner = _worldToCamera * transformed;
  texture_coordinate = vec2(0.0, 1.0);

  if (whichCorner == 0 || whichCorner == 3) {
    corner.x -= width * 0.5;
    texture_coordinate.x = 0.0;
  } else {
    corner.x += width * 0.5;
    texture_coordinate.x = 1.0;
  }
  
  if (whichCorner == 0 || whichCorner == 1) {
    //corner.y -= height * 0.5;
    texture_coordinate.y = 1.0;
  } else {
    corner.y += height;
    texture_coordinate.y = 0.0;
  }
  
  gl_Position = _cameraToClip * corner;
}""",
    glLineWidth=3,
    glPointSize=8)  # -> Color, Depth
