# Grasshopper definition billboard_02.gh (Grasshopper 1.0.7)
# plug-ins: ghgl

pt = Point([Point(-7.653172522, -8.604730028, 0), Point(-7.092159532, 7.817760743, 0), Point(10.31744125, 10.8745758, 0), Point(11.81542902, -10.72284824, 0)])
panel = Panel("http://assets.stickpng.com/thumbs/5845e13e7733c3558233c0ec.png")
number_slider = Slider(11, range=1..100)
gl_shader = GLShader(
    Vertex=pt,
    Image=panel,
    Width=number_slider,
    Height=number_slider,
    DepthTestingEnabled=False,
    DepthWritingEnabled=True,
    DrawMode=0,
    FragmentShader="""#version 330

uniform sampler2D image;
in vec2 texture_coordinate;
out vec4 fragment_color;

void main() {
  fragment_color = texture(image, texture_coordinate);
  if (fragment_color.a < 0.1) {
    discard;
  }
}""",
    GLShader=(0, 2, 0),
    GeometryShader="""#version 330 core

layout(points) in;
layout(triangle_strip, max_vertices = 4) out;

uniform float width;
uniform float height;
uniform mat4 _worldToCamera;
uniform mat4 _cameraToClip;

out vec2 texture_coordinate;

void main() {
  vec4 pt = _worldToCamera * gl_in[0].gl_Position;
  
  texture_coordinate = vec2(0.0,1.0);
  vec4 corner = _cameraToClip * vec4(pt.x - width * 0.5, pt.y - height * 0.5, pt.z, 1.0);
  gl_Position = corner;
  EmitVertex();

  texture_coordinate = vec2(1.0,1.0);
  corner = _cameraToClip * vec4(pt.x + width * 0.5, pt.y - height * 0.5, pt.z, 1.0);
  gl_Position = corner;
  EmitVertex();

  texture_coordinate = vec2(0.0,0.0);
  corner = _cameraToClip * vec4(pt.x - width * 0.5, pt.y + height * 0.5, pt.z, 1.0);
  gl_Position = corner;
  EmitVertex();

  texture_coordinate = vec2(1.0,0.0);
  corner = _cameraToClip * vec4(pt.x + width * 0.5, pt.y + height * 0.5, pt.z, 1.0);
  gl_Position = corner;
  EmitVertex();

  EndPrimitive();
}""",
    PreviewSortOrder=5,
    VertexShader="""#version 330

layout(location = 0) in vec3 vertex;

void main() {
  gl_Position = vec4(vertex, 1.0);
}""",
    glLineWidth=3,
    glPointSize=8)  # -> Color, Depth
