# Grasshopper definition chained.gh (Grasshopper 1.0.7)
# plug-ins: ghgl

pt = Point([Point(-1, -1, -1), Point(1, -1, -1), Point(1, 1, -1), Point(-1, 1, -1)])
halftone = GLShader(
    Vertex=pt,
    DepthTestingEnabled=False,
    DepthWritingEnabled=False,
    DrawMode=6,
    FragmentShader="""#version 330

uniform sampler2D _initialColorBuffer;
uniform sampler2D _initialDepthBuffer;
uniform vec2 _viewportSize;

#pragma glslify: halftone = require('glsl-halftone')

void main()
{
  vec2 uv = gl_FragCoord.xy / _viewportSize;
  vec4 color = texture(_initialColorBuffer, uv);
  float depth = texture(_initialDepthBuffer, uv).x;
  if(depth<0.99)
  {
    vec2 st = uv*10.0;
    st.x *= _viewportSize.x / _viewportSize.y;
    vec3 rgb = halftone(color.rgb, st);
    gl_FragColor = vec4(rgb,1.0);
  }
  else
    gl_FragColor = color;
}""",
    GLShader=(0, 2, 0),
    PreviewSortOrder=5,
    VertexShader="""#version 330

layout(location = 0) in vec3 vertex;

void main() 
{
  gl_Position = vec4(vertex,1);
}""",
    glLineWidth=3,
    glPointSize=8)  # -> Color, Depth
edge_detect = GLShader(
    Vertex=pt,
    DepthTestingEnabled=False,
    DepthWritingEnabled=False,
    DrawMode=6,
    FragmentShader="""#version 330 core

uniform sampler2D _initialDepthBuffer;
uniform vec2 _viewportSize;
void main() 
{
  vec2 uv = gl_FragCoord.xy / _viewportSize;

  vec2 coord = gl_FragCoord.xy;
  float depth0 = texture(_initialDepthBuffer, coord/_viewportSize).x;
  coord.x += 5.0;
  float depth1 = texture(_initialDepthBuffer, coord/_viewportSize).x;
  if((depth0>0.9 && depth1<0.9) || (depth0<0.9 && depth1>0.9))
    gl_FragColor = vec4(1,0,0,1);
  else
    gl_FragColor = vec4(0,0,0,0);
}""",
    GLShader=(0, 2, 0),
    PreviewSortOrder=5,
    VertexShader="""#version 330

layout(location = 0) in vec3 vertex;

void main() {
  gl_Position = vec4(vertex,1.0);
}""",
    glLineWidth=3,
    glPointSize=8)  # -> Color, Depth
downstream = GLShader(
    Vertex=pt,
    EdgeTexture=edge_detect.Color,
    HalftoneTexture=halftone.Color,
    DepthTestingEnabled=False,
    DepthWritingEnabled=False,
    DrawMode=6,
    FragmentShader="""#version 330

uniform sampler2D edgeTexture;
uniform sampler2D halftoneTexture;
uniform vec2 _viewportSize;

void main()
{
  vec2 uv = gl_FragCoord.xy / _viewportSize;
  float edge = texture(edgeTexture, uv).x;
  vec4 halftone = texture(halftoneTexture, uv);
  if( edge > 0.95 )
    gl_FragColor = vec4(1,0,0,1.0);
  else
    gl_FragColor = halftone;
}""",
    GLShader=(0, 2, 0),
    PreviewSortOrder=5,
    VertexShader="""#version 330

layout(location = 0) in vec3 vertex;

void main() 
{
  gl_Position = vec4(vertex,1);
}""",
    glLineWidth=3,
    glPointSize=8)  # -> Color, Depth
