# Grasshopper definition draftangle.gh (Grasshopper 1.0.7)
# plug-ins: ghgl

num = Number(1)
brep = Brep([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])
num_2 = Number(0)
num_3 = Number(5)
vec = VectorXYZ(XComponent=0, YComponent=0, ZComponent=num)  # -> Vector, Length
mesh = Mesh(brep)
draft_angle_preview = GLMeshShader(
    M=mesh,
    Angle0=num_2,
    Angle1=num_3,
    Up=vec.Vector,
    DepthTestingEnabled=True,
    DepthWritingEnabled=True,
    DrawMode=4,
    FragmentShader="""#version 330

in  vec3 normal;
out vec4 FragColor;

uniform float angle0;
uniform float angle1;
uniform vec3 up;

const float ON_PI = 3.14159;

vec3 HSVToRGB(float h, float s, float v)
{
  if (s < 0.000001)
    return vec3(v,v,v);

  // okay - h should be in radians - we need to scale it to be 0->6
  //h = h * ( 30.0 / ON_PI);
  h = h * 3.0 / ON_PI;  // (6.0 / 2.0 * ON_PI);

  float i = floor(h);
    
  if ( i > 5.0 || i < 0.0)
  {
    i = 0.0;
    h = 0.0;
  }

  float f = h - i;
  float p = v * ( 1.0 - s);
  float q = v * ( 1.0 - ( s * f) );
  float t = v * ( 1.0 - ( s * ( 1.0 - f) ) );

  if( i<0.1 )
    return vec3(v,t,p);

  if( i<1.1 )
    return vec3(q,v,p);

  if( i<2.1 )
    return vec3(p,v,t);

  if( i<3.1 )
    return vec3(p,q,v);

  if( i<4.1 )
    return vec3(t,p,v);

  return vec3(v,p,q);
}

vec4 DraftAngleFalseColor( float f, float mn, float mx )
{
  float BAD_COLOR_HUE = 0.0;             // red
  float GOOD_COLOR_HUE =  ON_PI*4.0/3.0; // blue 

  float t = (f-mn)/(mx-mn);
  if ( t <= 0.0)
    t = 0.0;
  else if ( t >= 1.0)
    t = 1.0;
  float hue = (1.0-t)*BAD_COLOR_HUE + t*GOOD_COLOR_HUE;
  vec3 rgb = HSVToRGB(hue, 1.0, 1.0);
  return vec4(rgb, 1.0);
}

void main()
{
  float min_dot = cos((90.0-angle0)* ON_PI/180.0);
  float max_dot = cos((90.0-angle1)* ON_PI/180.0);
  vec3 u = normalize(up);
  FragColor = DraftAngleFalseColor(dot(normal,u), min_dot, max_dot);
}""",
    GLShader=(0, 1, 0),
    PreviewSortOrder=5,
    VertexShader="""#version 330

layout(location = 0) in vec3 _meshVertex;
layout(location = 1) in vec3 _meshNormal;

uniform mat4 _worldToClip;
out vec3 normal;

void main() 
{
  normal = _meshNormal;
  gl_Position = _worldToClip * vec4(_meshVertex,1);
}""",
    glLineWidth=3,
    glPointSize=8)
