# Grasshopper definition edgedraw.gh (Grasshopper 1.0.7)
# plug-ins: ghgl

colour = ColourPicker(PickedColour=RGB(77, 255, 124))
colour_2 = ColourPicker(PickedColour=RGB(0, 166, 44))
brep = Brep([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])
c_script = CSharpScript(breps=brep)  # -> pos0, pos1, fn0, fn1; inputs breps: list of Brep
# ---------- c_script: C# ----------
    var _pos0 = new List<Point3d>();
    var _pos1 = new List<Point3d>();
    var _fn0 = new List<Vector3d>();
    var _fn1 = new List<Vector3d>();

    foreach( var brep in breps)
    {
      var meshes = Mesh.CreateFromBrep(brep, MeshingParameters.QualityRenderMesh);
      foreach(var mesh in meshes)
      {
        mesh.FaceNormals.ComputeFaceNormals();

        for( int i = 0; i < mesh.TopologyEdges.Count; i++ )
        {
          var pair = mesh.TopologyEdges.GetTopologyVertices(i);
          _pos0.Add(mesh.TopologyVertices[pair.I]);
          _pos1.Add(mesh.TopologyVertices[pair.J]);
          var faceIndices = mesh.TopologyEdges.GetConnectedFaces(i);
          _fn0.Add(mesh.FaceNormals[faceIndices[0]]);
          if( faceIndices.Length > 1 )
            _fn1.Add(mesh.FaceNormals[faceIndices[1]]);
          else
            _fn1.Add(new Vector3d());
        }
      }
    }
    pos0 = _pos0;
    pos1 = _pos1;
    fn0 = _fn0;
    fn1 = _fn1;
# ---------- end c_script ----------
col = Colour(RGB(223, 42, 255))
c_script_2 = CSharpScript(dashed=Toggle(False))  # -> out, outPattern, outPatternFactor; inputs dashed: Boolean
# ---------- c_script_2: C# ----------
    uint current_pattern = 0xFFFF;// pattern; // 0xFFFF == solidline
    if(dashed)
      current_pattern = 4369;
    int pattern_length = 0;

    // strip the bitfield to figure out the pattern
    float[] pattern = new float[8];
    bool solid = false;
    for (int bit_index = 0; bit_index < 16; bit_index++)
    {
      solid = (current_pattern & (1 << bit_index)) != 0;
      bool in_correct_slot = (solid && pattern_length % 2 == 0) || (!solid && pattern_length % 2 == 1);
      if (!in_correct_slot)
      {
        pattern_length++;
        if (pattern_length > 7)
          break;
      }
      pattern[pattern_length] += 1;
    }

    bool all_same = true;
    for (int i = 1; i < 4; i++)
    {
      if (pattern[0] != pattern[i * 2] || pattern[1] != pattern[i * 2 + 1])
        all_same = false;
    }
    if (all_same && pattern_length > 2)
      pattern_length = 2;

    float factor = 2;// (float) patternFactor;
    for (int pattern_index = 0; pattern_index < pattern_length; pattern_index++)
      pattern[pattern_index] = factor * pattern[pattern_index];

    outPattern = pattern;
    outPatternFactor = factor;
# ---------- end c_script_2 ----------
gl_shader = GLShader(
    Pos0=c_script.pos0,
    Pos1=c_script.pos1,
    Fn0=c_script.fn0,
    Fn1=c_script.fn1,
    Silcolor=colour,
    Creasecolor=colour_2,
    Bordercolor=col,
    WireThickness=Slider(4.06, range=0..10),
    DrawSilhouette=Toggle(True),
    DrawCrease=Toggle(True),
    DrawBorder=Toggle(True),
    Pattern=c_script_2.outPattern,
    PatternLength=c_script_2.outPatternFactor,
    DepthTestingEnabled=False,
    DepthWritingEnabled=False,
    DrawMode=0,
    FragmentShader="""#version 330

flat in vec4 gs_color;
flat in int x_dominant;

uniform float pattern[8];
uniform int patternLength;

out vec4 FragColor;

void main()
{
  if (patternLength > 0) {
    vec2 coord = vec2(gl_FragCoord.xy - 0.5);
    float total_length = 0;
    for (int i = 0; i < patternLength; i++)
      total_length += pattern[i];

    float length_along_pattern = 0;
    float t = x_dominant!=0 ? coord.x : coord.y;
    float position_in_pattern = mod(t, total_length);
    for (int i = 0; i < patternLength; i++) {
      length_along_pattern += pattern[i];
      if (length_along_pattern > position_in_pattern) {
        if (mod(i, 2) == 1)
          discard;
        break;
      }
    }
  }
  FragColor = gs_color;
}""",
    GLShader=(0, 1, 0),
    GeometryShader="""#version 330 core
layout (std140) uniform;

layout(points) in;
layout(triangle_strip, max_vertices = 12) out;

uniform vec4 silcolor;
uniform vec4 creasecolor;
uniform vec4 bordercolor;
uniform float wireThickness;
uniform int drawSilhouette;
uniform int drawCrease;
uniform int drawBorder;

uniform mat4 _worldToClip;
uniform vec3 _cameraLocation;
uniform vec2 _viewportSize;

in vec3 vs_position0[];
in vec3 vs_position1[];
in vec3 vs_normal0[];
in vec3 vs_normal1[];

flat out vec4 gs_color;
flat out int x_dominant;



#ifdef CLIPPLANES
uniform int  clipplane_count;
uniform vec4 clipplanes[8];

out gl_PerVertex {
 vec4 gl_Position;
 float gl_PointSize;
 float gl_ClipDistance[8];
};
#endif


void HandleClippingPlanes( in vec4 clip_vert )
{
#ifdef CLIPPLANES
  // 29 Sept 2016 S. Baer - I realize the following looks really dumb, but
  // please don't try to shorten the loop. My Intel HD 520 driver will
  // not properly work (no clipping and random colors) with a short
  // version of the loop
  vec4 clip = vec4(clip_vert.x, clip_vert.y, -clip_vert.z, clip_vert.w);
  for (int i = 0; i < clipplane_count; i++)
  {
    float distance = dot(clip, clipplanes[i]);
    if (0 == i) gl_ClipDistance[0] = distance;
    if (1 == i) gl_ClipDistance[1] = distance;
    if (2 == i) gl_ClipDistance[2] = distance;
    if (3 == i) gl_ClipDistance[3] = distance;
    if (4 == i) gl_ClipDistance[4] = distance;
    if (5 == i) gl_ClipDistance[5] = distance;
    if (6 == i) gl_ClipDistance[6] = distance;
    if (7 == i) gl_ClipDistance[7] = distance;
  }
#endif
}


vec2 ClipToScreen(in vec4 clip)
{
  float x = _viewportSize.x * (1.0f + clip.x / clip.w) * 0.5f;
  float y = _viewportSize.y * (1.0f + clip.y / clip.w) * 0.5f;
  return vec2(x, y);
}

vec2 ScreenToClip(in vec2 screen)
{
  float x = 2.0f * screen.x / _viewportSize.x - 1.0f;
  float y = 2.0f * screen.y / _viewportSize.y - 1.0f;
  return vec2(x, y);
}

vec2 RotatePoint(in vec2 p, in float angle, in vec2 center)
{
  angle = radians(angle);
  float s = sin(angle);
  float c = cos(angle);

  // translate point back to origin:
  p = p - center;

  // rotate point
  float xnew = p.x * c - p.y * s;
  float ynew = p.x * s + p.y * c;

  // translate point back:
  p.x = xnew + center.x;
  p.y = ynew + center.y;
  return p;
}

void Emit(vec4 v)
{
  HandleClippingPlanes(v);
  gl_Position = v;
  EmitVertex();
}

void MakeCap(in vec2 screen_pt, in vec2 thickness_direction, in vec4 clip_pt, in bool start)
{
  float angles[4] = start ? float[](72, 108, 36, 144)
    : float[](-36, -144, -72, -108);
  for (int i = 0; i < 4; i++)
  {
    float angle = angles[i];
    vec2 screen = RotatePoint(screen_pt + thickness_direction, angle, screen_pt);
    RotatePoint(vec2(0, 1), angle, vec2(0, 0));

    vec2 clip = ScreenToClip(screen);
    Emit( vec4(clip.x*clip_pt.w, clip.y*clip_pt.w, clip_pt.z, clip_pt.w) );
  }
}

void GetThickLinePoints(in vec4 clip_pt1, in vec4 clip_pt2, in float thickness)
{
  vec2 screen_pt1 = ClipToScreen(clip_pt1);
  vec2 screen_pt2 = ClipToScreen(clip_pt2);

  float half_thickness = thickness * 0.5;
  if (half_thickness <= 0.0f)
    return;
  float screen_distance = distance(screen_pt1, screen_pt2);
  if (screen_distance < 0.01)
  {
    // we could draw small dot here which would cover looking
    // straight down a line
    return;
  }

  vec3 toward_eye = vec3(0, 0, 1);
  vec3 ptop = vec3((screen_pt2 - screen_pt1).xy, 0);
  ptop = normalize(ptop);
  x_dominant = 1;
  if (abs(ptop.x) < abs(ptop.y))
    x_dominant = 0;

  if (thickness<2.01 && (abs(ptop.x)>0.999999 || abs(ptop.y)>0.999999)) {
    vec2 snap = round(screen_pt1);
    if (x_dominant == 1) {
      if (thickness<1.01) {
        if (snap.y>screen_pt1.y)
          snap.y = snap.y - 0.5;
        else
          snap.y = snap.y + 0.5;
      }
      screen_pt1.y = snap.y;
      screen_pt2.y = snap.y;
    }
    else {
      if (thickness<1.01) {
        if (snap.x>screen_pt1.x)
          snap.x = snap.x - 0.5;
        else
          snap.x = snap.x + 0.5;
      }
      screen_pt1.x = snap.x;
      screen_pt2.x = snap.x;
    }
  }

  vec2 thickness_direction = cross(toward_eye, ptop).xy;
  thickness_direction = normalize(thickness_direction);
  thickness_direction *= half_thickness;

#ifdef VMWARE
  const float thickness_threshold = 0;
#else
  const float thickness_threshold = 3;
#endif
  if (thickness > thickness_threshold)
    MakeCap(screen_pt1, thickness_direction, clip_pt1, true);

  vec2 screen = screen_pt1 + thickness_direction;
  vec2 clip = ScreenToClip(screen);
  Emit( vec4(clip.x*clip_pt1.w, clip.y*clip_pt1.w, clip_pt1.z, clip_pt1.w) );

  screen = screen_pt1 - thickness_direction;
  clip = ScreenToClip(screen);
  Emit( vec4(clip.x*clip_pt1.w, clip.y*clip_pt1.w, clip_pt1.z, clip_pt1.w) );

  screen = screen_pt2 + thickness_direction;
  clip = ScreenToClip(screen);
  Emit( vec4(clip.x*clip_pt2.w, clip.y*clip_pt2.w, clip_pt2.z, clip_pt2.w) );

  screen = screen_pt2 - thickness_direction;
  clip = ScreenToClip(screen);
  Emit( vec4(clip.x*clip_pt2.w, clip.y*clip_pt2.w, clip_pt2.z, clip_pt2.w) );

  if (thickness > thickness_threshold)
    MakeCap(screen_pt2, thickness_direction, clip_pt2, false);
}



bool IsSilhouette(in vec3 position1, in vec3 position2){
  vec3 midpoint = (position1+position2) * 0.5;
  vec3 midToCam = normalize(_cameraLocation - midpoint);
  float d0 = dot(midToCam, vs_normal0[0]);
  float d1 = dot(midToCam, vs_normal1[0]);
  bool is_silhouette = (d0 * d1) < 0;
  return is_silhouette;
}

bool IsCrease(in vec3 normal1, in vec3 normal2) {
  float angle = acos( min( 1.0f, max( -1.0f, (normal1.x * normal2.x) + 
                                        (normal1.y * normal2.y) +
                                        (normal1.z * normal2.z) ) ) );
  const float minAngle = 3.14159265 / 6.0f;
  bool is_crease = abs(angle) > minAngle;
  return is_crease;
}

// Helper constants and types for 4D homogeneous drawing routines...
const int XLO = 1;
const int XHI = 2;
const int YLO = 4;
const int YHI = 8;
const int ZLO = 16;
const int ZHI = 32;

int clipping_SideFlag(in vec4 q)
{
  int side = 0;
  float w = abs(q.w);
  if (abs(q.x)>w) side |= q.x>q.w ? XHI : XLO;
  if (abs(q.y)>w) side |= q.y>q.w ? YHI : YLO;
  if (abs(q.z)>w) side |= q.z>q.w ? ZHI : ZLO;
  return side;
}

void snip(in float px, in float py, in float qx, in float qy, inout float t0, inout float t1)
{
  const float small_float = 1e-10f;

  float t0_local = 0.0f;
  float t1_local = 1.0f;

  // check which side of line P and Q are with respect to x=y
  // in this case (+) means x-y>0
  bool positive_p = (px - py) > 0;
  bool positive_q = (qx - qy) > 0;
  if (positive_p != positive_q)
  {
    // snip against x=y line
    // (1-t)P + tQ = R = (c,c)
    // (1-t)Px + tQx = (1-t)Py +tQy
    // t = (Px-Py) / (Px-Py-Qx+Qy)
    float denom = px - py - qx + qy;
    if (abs(denom) > small_float) {
      float posxy_t = (px - py) / denom;
      if (positive_p) //reduce t1
        t1_local = posxy_t < t1_local ? posxy_t : t1_local;
      else // increase t0
        t0_local = posxy_t > t0_local ? posxy_t : t0_local;
    }
  }
  // check which side of line P and Q are with respect to x=-y
  // in this case (+) means X+y>0
  positive_p = (px + py) > 0;
  positive_q = (qx + qy) > 0;
  if (positive_p != positive_q) {
    // snip against x=-y line
    // (1-t)P + tQ = R = (c,-c)
    // (1-t)Px + tQx = -((1-t)Py +tQy)
    // t = (Px+Py) / (Px+Py-Qx-Qy)
    float denom = px + py - qx - qy;
    if (abs(denom) > small_float) {
      float negxy_t = (px + py) / denom;
      if (positive_p) //reduce t1
        t1_local = negxy_t < t1_local ? negxy_t : t1_local;
      else // increase t0
        t0_local = negxy_t > t0_local ? negxy_t : t0_local;
    }
  }
  if (t0_local >= t1_local)
    return;
  if (t0_local > t0)
    t0 = t0_local;
  if (t1_local < t1)
    t1 = t1_local;
}


void ClipToFrustum(inout vec4 start, inout vec4 end, in int start_side, in int end_side)
{
  float t0 = 0.0f;
  float t1 = 1.0f;

  if (((start_side | end_side) & (XLO | XHI)) != 0)
  {
    snip(start.w, start.x, end.w, end.x, t0, t1);
  }
  if (((start_side | end_side) & (YLO | YHI)) != 0)
  {
    snip(start.w, start.y, end.w, end.y, t0, t1);
  }
  if (((start_side | end_side) & (ZLO | ZHI)) != 0)
  {
    snip(start.w, start.z, end.w, end.z, t0, t1);
  }

  if (t0<t1)
  {
    // at this point 0.0 <= t0 < t1 <= 1.0.
    vec4 clip0 = mix(start, end, t0);
    vec4 clip1 = mix(start, end, t1);
    start = clip0;
    end = clip1;
  }
}

void main() {
  if(wireThickness<0.01)
    return;

  vec4 clip0 = _worldToClip*vec4(vs_position0[0],1);
  vec4 clip1 = _worldToClip*vec4(vs_position1[0],1);

  int side0 = clipping_SideFlag(clip0);
  int side1 = clipping_SideFlag(clip1);

  // bail if entire chord is outside clipping region
  if ((side0 & side1) != 0)
    return;

  bool silhouette = drawSilhouette==1 && IsSilhouette(vs_position0[0], vs_position1[0]);
  bool border = drawBorder==1 && vs_normal1[0].x==0.0 && vs_normal1[0].y==0.0 && vs_normal1[0].z==0.0;
  bool crease = drawCrease==1 && IsCrease(vs_normal0[0], vs_normal1[0]);

  bool draw = silhouette || border || crease;
  if( !draw )
    return;

  if( silhouette )
    gs_color = silcolor;
  if( border )
    gs_color = bordercolor;
  if( crease )
    gs_color = creasecolor;

  if (0 != side0 || 0 != side1)
  {
    ClipToFrustum(clip0, clip1, side0, side1);
  }

//  gl_Position = clip0;
//  EmitVertex();
//  gl_Position = clip1;
//  EmitVertex();
  GetThickLinePoints(clip0, clip1, wireThickness);

  EndPrimitive();
}""",
    PreviewSortOrder=5,
    VertexShader="""#version 330

layout(location = 0) in vec3 pos0;
layout(location = 1) in vec3 pos1;
layout(location = 2) in vec3 fn0;
layout(location = 3) in vec3 fn1;

uniform mat4 _worldToClip;

out vec3 vs_position0;
out vec3 vs_position1;
out vec3 vs_normal0;
out vec3 vs_normal1;

void main() 
{
  vs_position0 = pos0;
  vs_position1 = pos1;
  vs_normal0 = fn0;
  vs_normal1 = fn1;
}""",
    glLineWidth=4,
    glPointSize=8)
