# Grasshopper definition glslify-ShadingEffects.gh (Grasshopper 1.0.7)
# plug-ins: ghgl

diffuse_map = Text("fieldstone-c.jpg")
diffuse_blend = Slider(1, range=-1..1)
normal_map = Text("fieldstone-n.jpg")
bumptileu = Slider(6, range=0..101)
bumptilev = Slider(8, range=0..101)
diffuse = ColourSwatch(SwatchColor=RGB(255, 0, 0))
specular = ColourSwatch(SwatchColor=RGB(255, 255, 255))
diff_tile_u = Slider(6, range=0..101)
diff_tile_v = Slider(8, range=0..101)
use_alpha_for_transparency = BooleanToggle(True)
environment_map = Text("Nickel.bmp")
clear_coat = BooleanToggle(False)
env_blend = Slider(0.475, range=-1..1)
roughness = Slider(0.9, range=0..1)
brep = Brep([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])
mesh = Mesh(brep)
mcol = MeshColours(
    Mesh=mesh,
    Colours=[RGB(127, 255, 0), RGB(0, 100, 0), RGB(34, 139, 34), RGB(124, 252, 0), RGB(154, 205, 50), RGB(173, 255, 47), RGB(50, 205, 50), RGB(152, 251, 152)])
gl_mesh = GLMeshShader(
    M=mcol,
    Diffuse=diffuse,
    Specular=specular,
    DiffuseMap=diffuse_map,
    DiffBlend=diffuse_blend,
    DiffTileU=diff_tile_u,
    DiffTileV=diff_tile_v,
    AlphaTrans=use_alpha_for_transparency,
    NormalMap=normal_map,
    BumpAmount=Slider(-0.507, range=-1..1),
    BumpTileU=bumptileu,
    BumpTileV=bumptilev,
    MatcapMap=environment_map,
    EnvBlend=env_blend,
    ClearCoat=clear_coat,
    Roughness=roughness,
    DepthTestingEnabled=True,
    DepthWritingEnabled=True,
    DrawMode=4,
    FragmentShader="""#version 330

#pragma glslify: beckmann = require(glsl-specular-beckmann) 
#pragma glslify: phongSpec = require(glsl-specular-phong) 
#pragma glslify: blinnPhongSpec = require(glsl-specular-blinn-phong) 
#pragma glslify: lambert = require(glsl-diffuse-lambert) 
#pragma glslify: perturb = require('glsl-perturb-normal') 
#pragma glslify: matcap = require(matcap) 
 
#line 12

uniform sampler2D diffuseMap;
uniform sampler2D normalMap;
uniform sampler2D matcapMap;
uniform vec4  diffuse = vec4(0.8,0.0,0.0,1.0);
uniform vec4  specular = vec4(1.0);
uniform float diffBlend = 1.0;
uniform float diffTileU = 5.0;
uniform float diffTileV = 5.0;
uniform bool  alphaTrans = false;
uniform float roughness = 80.0;
uniform float bumpTileU = 5.0;
uniform float bumpTileV = 5.0;
uniform float bumpAmount = 1.0;
uniform float envBlend = 0.5;
uniform bool  clearCoat = false;

in vec3 Normal;
in vec3 viewDir;
in vec2 vUV;
in vec3 vertexPos;
in vec3 cameraPos;
in vec3 lightPos;

out vec4 fragColor;

void main() 
{
  vec3 eyeDirection = normalize(cameraPos - vertexPos);
  vec3 lightDirection = normalize(lightPos - vertexPos);
  vec3 normal = normalize(Normal);

  vec2 diffUV = vUV * vec2(diffTileU, diffTileV);
  vec4 diffRGBA = (diffBlend != 0.0) ? texture(diffuseMap, diffUV, 0) : vec4(0.0);

  vec2 bumpUV = vUV * vec2(bumpTileU+0.00001, bumpTileV+0.00001);
  vec3 normalRGB = texture(normalMap, bumpUV, 0).rgb;
  vec3 nMap = normalRGB * 2.0 - 1.0;
  bool doBump = ((bumpTileU > 0.0) || (bumpTileV > 0.0));

  float ba = bumpAmount;
  if (ba < 0.0)
  {
    ba = -bumpAmount;
    bumpUV = -bumpUV;
  }
  if (doBump)
  {
    float bm = pow(2, 1.0/(ba+0.02));
    
    // GLSLIFY method....
    normal = perturb(nMap, normal*bm, normalize(vertexPos), bumpUV);
  }

  // GLSLIFY method....
  vec2  envUV = matcap(eyeDirection, clearCoat ? Normal : normal);
  
  vec3  envColor = texture(matcapMap, envUV, 0).rgb;
  float r = (1.0-roughness) * 512.0;
  
  // GLSLIFY method....
  float spec = blinnPhongSpec(lightDirection, eyeDirection, normal, r);
  
  if (roughness <= 0.0)
    spec = 0.0;

  // GLSLIFY method....
  float diff = lambert(lightDirection, normal);
  
  vec3  diffColor = mix(diffuse, diffRGBA, diffBlend*diffRGBA.a*diffuse.a).rgb;

  fragColor = vec4(diffColor*diff + specular.rgb*spec, alphaTrans ? diffRGBA.a : diffuse.a);
  fragColor.rgb = mix(fragColor.rgb, envColor, envBlend);
}""",
    GLShader=(0, 1, 0),
    VertexShader="""#version 330

layout(location = 0) in vec3 _meshVertex;
layout(location = 1) in vec3 _meshNormal;
layout(location = 2) in vec2 _meshTextureCoordinate;

uniform mat4 _worldToClip;
uniform mat3 _worldToCameraNormal;
uniform vec3 _cameraLocation;

uniform vec3 lightPosition = vec3(0.0, -15.0, 15.0);

out vec3 Normal;
out vec3 viewDir;
out vec2 vUV;
out vec3 vertexPos;
out vec3 cameraPos;
out vec3 lightPos;

void main() 
{
  Normal    = _worldToCameraNormal * _meshNormal;
  vertexPos = _worldToCameraNormal * _meshVertex;
  viewDir   = -vertexPos;
  vUV       = _meshTextureCoordinate;
  lightPos  = _worldToCameraNormal * lightPosition;
  cameraPos = _worldToCameraNormal * _cameraLocation;
  gl_Position = _worldToClip * vec4(_meshVertex,1);
}""",
    glLineWidth=3,
    glPointSize=8)
