# Grasshopper definition glslify.gh (Grasshopper 1.0.7)
# plug-ins: ghgl

brep = Brep([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])
mesh = Mesh(brep)
mcol = MeshColours(
    Mesh=mesh,
    Colours=[RGB(127, 255, 0), RGB(0, 100, 0), RGB(34, 139, 34), RGB(124, 252, 0), RGB(154, 205, 50), RGB(173, 255, 47), RGB(50, 205, 50), RGB(152, 251, 152)])
gl_mesh = GLMeshShader(
    M=mcol,
    Factor=Slider(7, range=0..100),
    DepthTestingEnabled=True,
    DepthWritingEnabled=True,
    DrawMode=4,
    FragmentShader="""#version 330

uniform vec3 _lightDirection[4];
uniform mat3 _worldToCameraNormal;
uniform float factor;

in  vec3 normal;
out vec4 FragColor;

#pragma glslify: noise = require('glsl-noise/simplex/3d')

void main()
{
  vec3 l = normalize(_lightDirection[0]);
  vec3 camNormal = _worldToCameraNormal * normal;
  float intensity = dot(l,normalize(camNormal.xyz));
  vec4 diffuse = vec4(1,0,1,1);

  vec3 ambient = vec3(0.1,0.1,0.1) * diffuse.rgb;
  vec3 c = ambient + diffuse.rgb * abs(intensity);
  vec4 color = vec4(c, diffuse.a);
  float n = noise(normal*factor);
  color.r *= n;
  FragColor = color;
}""",
    GLShader=(0, 2, 0),
    PreviewSortOrder=5,
    VertexShader="""#version 330

layout(location = 0) in vec3 _meshVertex;
layout(location = 1) in vec3 _meshNormal;
layout(location = 2) in vec4 _meshVertexColor;

uniform mat4 _worldToClip;
out vec3 normal;
out vec4 vertexColor;
void main() 
{
  normal = _meshNormal;
  vertexColor = _meshVertexColor;
  gl_Position = _worldToClip * vec4(_meshVertex,1.0);
}""",
    glLineWidth=3,
    glPointSize=8)  # -> Color, Depth
