# Grasshopper definition gradient_conical.gh (Grasshopper 1.0.7)
# plug-ins: ghgl

range = Range(Domain=Domain(0, 1), Steps=9)
circle = Circle([{Plane=Plane(origin=(0, 1, 0), x=(-0.7071067812, -0.7071067812, 0), y=(0.7071067812, -0.7071067812, 0)), Radius=7.071067812}, {Plane=Plane(origin=(-7, 3, 0), x=(-0.894427191, -0.4472135955, 0), y=(0.4472135955, -0.894427191, 0)), Radius=2.236067977}, {Plane=Plane(origin=(9, -3, 0), x=(-0.8, -0.6, 0), y=(0.6, -0.8, 0)), Radius=5}, {Plane=Plane(origin=(-5, -10, 0), x=(0.316227766, 0.9486832981, 0), y=(-0.9486832981, 0.316227766, 0)), Radius=6.32455532}])
gradient = Gradient(
    LowerLimit=0,
    UpperLimit=1,
    Parameter=range,
    stops=[0: RGB(243, 57, 0), 0.1: RGB(236, 27, 60), 0.2: RGB(210, 0, 118), 0.3: RGB(103, 0, 120), 0.4: RGB(39, 72, 161), 0.5: RGB(1, 192, 229), 0.6: RGB(18, 178, 90), 0.7: RGB(79, 186, 8), 0.8: RGB(220, 237, 32), 0.9: RGB(247, 159, 20), 1: RGB(243, 57, 0)])
runion = RegionUnion(Curves=circle)
pt = Point(Point(0.7457488062, 0.2900134246, 0))
boundary = BoundarySurfaces(Edges=runion)
conical_gradient = GLMeshShader(
    M=boundary,
    Center=pt,
    Colors_10=gradient,
    DepthTestingEnabled=True,
    DepthWritingEnabled=True,
    DrawMode=4,
    FragmentShader="""#version 330

uniform vec4 colors[10];

in vec2 ptOnPlane;
out vec4 final_pixel;

void main()
{
  float y = abs(ptOnPlane.y);
  float angle = atan(y, ptOnPlane.x);
  if(ptOnPlane.y<0.0)
    angle = 3.14159 * 2.0 - angle;
  float percent = (angle) / (3.14159*2.0);
  //float t = percent;
  
  float t = clamp(percent*10, 0.0, 9.0);
  final_pixel = mix(colors[int(t)], colors[int(t+1.0)], t-floor(t));
  
  //final_pixel =  mix(color0, color1, t);
}""",
    GLShader=(0, 2, 0),
    PreviewSortOrder=5,
    VertexShader="""#version 330

layout(location = 0) in vec3 _meshVertex;

uniform mat4 _worldToClip;
uniform vec3 center;

out vec2 ptOnPlane;

void main() 
{
  vec2 pt = vec2(_meshVertex.x - center.x, _meshVertex.y - center.y);
  ptOnPlane = pt;

  gl_Position = _worldToClip * vec4(_meshVertex,1.0);
}""",
    glLineWidth=3,
    glPointSize=8)  # -> Color, Depth
