# Grasshopper definition hello_shader.gh (Grasshopper 1.0.7)
# plug-ins: ghgl

C = Curve(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)
dedomain = DeconstructDomain(Domain=C)  # -> Start, End
divide = DivideCurve(Curve=C, Count=Slider(699, range=0..1000), Kinks=False)  # -> Points, Tangents, Parameters
gradient = Gradient(
    LowerLimit=dedomain.Start,
    UpperLimit=dedomain.End,
    Parameter=divide.Parameters,
    stops=[0: RGB(243, 57, 0), 0: RGB(173, 188, 234), 0.1: RGB(236, 27, 60), 0.2: RGB(210, 0, 118), 0.254: RGB(103, 0, 120), 0.366: RGB(39, 72, 161), 0.5: RGB(1, 192, 229), 0.6: RGB(18, 178, 90), 0.7: RGB(79, 186, 8), 0.8: RGB(220, 237, 32), 0.9: RGB(247, 159, 20), 1: RGB(243, 57, 0)])
gl_shader = GLShader(
    Vertex=divide.Points,
    Vcolor=gradient,
    DepthTestingEnabled=True,
    DepthWritingEnabled=True,
    DrawMode=0,
    FragmentShader="""#version 330

in vec4 vertex_color;

void main()
{
  gl_FragColor = vertex_color;
}""",
    GLShader=(0, 1, 0),
    PreviewSortOrder=5,
    VertexShader="""#version 330

layout(location = 0) in vec3 vertex;
layout(location = 1) in vec4 vcolor;
uniform mat4 _worldToClip;
out vec4 vertex_color;

void main() 
{
  vertex_color = vcolor;
  gl_Position = _worldToClip * vec4(vertex,1.0);
}""",
    glLineWidth=3,
    glPointSize=8)
