# Grasshopper definition image_mix.gh (Grasshopper 1.0.7)
# plug-ins: ghgl

rec = Rectangle({Plane=PlaneXY(0.5026656836, 7.262556313, 0), Size=Domain2(u=-79.09534547..79.09534547, v=-62.00747653..62.00747653)})
pt = Point(Point(-3, 3, 0))
txt = Text("quito_graffiti.jpg")
txt_2 = Text("iguana.jpg")
gl_shader = GLShader(
    World_vertex=pt,
    Radius=Slider(26, range=1..1050),
    Graffiti=txt,
    Iguana=txt_2,
    MixAmount=Slider(0.67, range=0..1),
    DepthTestingEnabled=True,
    DepthWritingEnabled=True,
    DrawMode=0,
    FragmentShader="""#version 330 core

uniform vec2 _viewportSize;
uniform sampler2D graffiti;
uniform sampler2D iguana;
uniform float mixAmount;

in vec2 texture_coordinate;
out vec4 fragment_color;

void main() {
  vec4 c0 = texture(graffiti, texture_coordinate);
  vec4 c1 = texture(iguana, texture_coordinate);
  fragment_color = mix(c0, c1, mixAmount);
}""",
    GLShader=(0, 2, 0),
    GeometryShader="""#version 330 core

layout(points) in;
layout(triangle_strip, max_vertices = 4) out;

uniform float radius;
uniform mat4 _worldToClip;

out vec2 texture_coordinate;

void main() {
  vec4 center = gl_in[0].gl_Position;

  // expand single point into a quad
  texture_coordinate = vec2(0.0, 1.0);
  gl_Position = _worldToClip * vec4(center.x-radius, center.y-radius, center.z, 1);
  EmitVertex();

  texture_coordinate = vec2(1.0, 1.0);
  gl_Position = _worldToClip * vec4(center.x+radius, center.y-radius, center.z, 1);
  EmitVertex();

  texture_coordinate = vec2(0.0, 0.0);
  gl_Position = _worldToClip * vec4(center.x-radius, center.y+radius, center.z, 1);
  EmitVertex();

  texture_coordinate = vec2(1.0, 0.0);
  gl_Position = _worldToClip * vec4(center.x+radius, center.y+radius, center.z, 1);
  EmitVertex();

  EndPrimitive();
}""",
    PreviewSortOrder=5,
    VertexShader="""#version 330

layout(location = 0) in vec3 world_vertex;

void main() {
  gl_Position = vec4(world_vertex, 1.0);
}""",
    glLineWidth=3,
    glPointSize=8)  # -> Color, Depth
