# Grasshopper definition mesh_normals.gh (Grasshopper 1.0.7)
# plug-ins: ghgl

brep = Brep([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])
move = Move(Geometry=brep, Motion=Vector(0, 30, 0))  # -> Geometry, Transform
path = FilePath("C:\dev\github\mcneel\ghgl\tests\quito_graffiti.jpg")
vec = Vector(Vector(0, 15, 0))
gl_mesh = GLMeshShader(
    M=brep,
    Translate=vec,
    DepthTestingEnabled=True,
    DepthWritingEnabled=True,
    DrawMode=4,
    FragmentShader="""#version 330

in vec4 color;
out vec4 fragment_color;

void main() {
  fragment_color = color;
}""",
    GLShader=(0, 2, 0),
    PreviewSortOrder=5,
    VertexShader="""#version 330

layout(location = 0) in vec3 _meshVertex;
layout(location = 1) in vec3 _meshNormal;

uniform mat4 _worldToClip;
uniform vec3 translate;
out vec4 color;

void main() {
  color = vec4(_meshNormal, 1.0);
  vec3 vertex = _meshVertex + translate;
  gl_Position = _worldToClip * vec4(vertex, 1.0);
}""",
    glLineWidth=3,
    glPointSize=5)  # -> Color, Depth
textured_mesh = GLMeshShader(
    M=move.Geometry,
    Image=path,
    DepthTestingEnabled=True,
    DepthWritingEnabled=True,
    DrawMode=4,
    FragmentShader="""#version 330

uniform sampler2D image;

in vec2 tc;
out vec4 fragment_color;

void main() {
  fragment_color = texture(image, tc);
}""",
    GLShader=(0, 2, 0),
    PreviewSortOrder=5,
    VertexShader="""#version 330

layout(location = 0) in vec3 _meshVertex;
layout(location = 1) in vec2 _meshTextureCoordinate;

uniform mat4 _worldToClip;
out vec2 tc;

void main() {
  tc = _meshTextureCoordinate;
  gl_Position = _worldToClip * vec4(_meshVertex,1.0);
}""",
    glLineWidth=3,
    glPointSize=8)  # -> Color, Depth
points = GLMeshShader(
    M=brep,
    DepthTestingEnabled=True,
    DepthWritingEnabled=True,
    DrawMode=0,
    FragmentShader="""#version 330

in vec4 color;
out vec4 fragment_color;
void main()
{
  fragment_color = color;
}""",
    GLShader=(0, 2, 0),
    PreviewSortOrder=5,
    VertexShader="""#version 330

layout(location = 0) in vec3 _meshVertex;
layout(location = 1) in vec3 _meshNormal;

uniform mat4 _worldToClip;
out vec4 color;

void main() 
{
  color = vec4(_meshNormal, 1.0);
  gl_Position = _worldToClip * vec4(_meshVertex,1.0);
}""",
    glLineWidth=3,
    glPointSize=5)  # -> Color, Depth
