# Grasshopper definition mesh_toon_animate.gh (Grasshopper 1.0.7)
# plug-ins: ghgl

col = Colour(RGB(168, 236, 255))
brep = Brep([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])
gl_mesh = GLMeshShader(
    M=brep,
    MaterialColor=col,
    Divs=Slider(5.1, range=1..30),
    UseTime=Toggle(False),
    DepthTestingEnabled=True,
    DepthWritingEnabled=True,
    DrawMode=4,
    FragmentShader="""#version 330

uniform vec3 _lightDirection[4];
uniform vec4 materialColor;
uniform float _time;
uniform mat3 _worldToCameraNormal;
uniform mat4 _worldToCamera;

uniform float divs;
uniform bool useTime;

in vec3 normal;
out vec4 fragcolor;

void main() {
  vec3 l = normalize(_lightDirection[0]);
  vec3 camNormal = _worldToCameraNormal * normal;
  float intensity = abs(dot(l, normalize(camNormal.xyz)));
  int i = int(intensity * divs);
  intensity = float(i / divs);
  if(useTime) {
    int iTime = int(_time);
    float t = _time - iTime;
    intensity += t;
    if(intensity > 1)
      intensity -= 1;
  }

  vec3 ambient = vec3(0.1, 0.1, 0.1) * materialColor.rgb;
  vec3 c = ambient + materialColor.rgb * intensity;
  fragcolor = vec4(c, materialColor.a);
}""",
    GLShader=(0, 2, 0),
    PreviewSortOrder=5,
    VertexShader="""#version 330

layout(location = 0) in vec3 _meshVertex;
layout(location = 1) in vec3 _meshNormal;

uniform mat4 _worldToClip;
out vec3 normal;

void main() {
  normal = _meshNormal;
  gl_Position = _worldToClip * vec4(_meshVertex,1.0);
}""",
    glLineWidth=3,
    glPointSize=8)  # -> Color, Depth
