# Grasshopper definition point_at.gh (Grasshopper 1.0.7)
# plug-ins: ghgl

crv = Curve(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)
crv_2 = Curve(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)
domain = Domain(crv)
dedomain = DeconstructDomain(Domain=domain)  # -> Start, End
multiplication = Multiplication(A=dedomain.End, B=Slider(0.399, range=0..1))
divide = DivideCurve(Curve=crv_2, Count=Slider(932, range=0..100500), Kinks=False)  # -> Points, Tangents, Parameters
eval = EvaluateCurve(Curve=crv, Parameter=multiplication)  # -> Point, Tangent, Angle
gl_shader = GLShader(
    Vertex=divide.Points,
    Attractor=eval.Point,
    DepthTestingEnabled=True,
    DepthWritingEnabled=True,
    DrawMode=0,
    FragmentShader="""#version 330
in vec4 fs_color;

void main() {
  gl_FragColor = fs_color;
}""",
    GLShader=(0, 1, 0),
    GeometryShader="""#version 330
layout(points) in;
layout(triangle_strip, max_vertices = 10) out;

uniform vec2 _viewportSize;
uniform mat4 _worldToClip;
uniform vec3 attractor;

out vec4 fs_color;
vec2 ClipToScreen(vec4 clip)
{
  float x = _viewportSize.x * (1.0f + clip.x / clip.w) * 0.5f;
  float y = _viewportSize.y * (1.0f + clip.y / clip.w) * 0.5f;
  return vec2(x, y);
}

vec2 ScreenToClip(vec2 screen)
{
  float x = 2.0f * screen.x / _viewportSize.x - 1.0f;
  float y = 2.0f * screen.y / _viewportSize.y - 1.0f;
  return vec2(x, y);
}

void main()
{
  vec4 tip_world = gl_in[0].gl_Position;
  vec4 tip_clip = _worldToClip * tip_world;
  vec2 tip_screen = ClipToScreen(tip_clip);
  vec4 attractor_base = vec4(attractor,1);
  vec4 attractor_clip = _worldToClip * attractor_base;
  vec2 attractor_screen = ClipToScreen(attractor_clip);
  vec2 toward = normalize(attractor_screen-tip_screen);
  float r = (toward.x+1.0)/2.0;
  float g = (toward.y+1.0)/2.0;
  fs_color = vec4(r,g,0.6, 1);
  vec3 perp3 = cross(vec3(0,0,1), vec3(toward,0));
  vec2 perp = normalize(vec2(perp3.x,perp3.y));

  float offset = 15;

  vec2 screen = tip_screen;
  vec2 clip = ScreenToClip(screen);
  gl_Position = vec4(clip.x*tip_clip.w, clip.y*tip_clip.w, tip_clip.z, tip_clip.w);
  EmitVertex();

  screen = (tip_screen-toward*offset) - perp*offset;
  clip = ScreenToClip(screen);
  gl_Position = vec4(clip.x*tip_clip.w, clip.y*tip_clip.w, tip_clip.z, tip_clip.w);
  EmitVertex();

  screen = (tip_screen-toward*offset) + perp*offset;
  clip = ScreenToClip(screen);
  gl_Position = vec4(clip.x*tip_clip.w, clip.y*tip_clip.w, tip_clip.z, tip_clip.w);
  EmitVertex();

  //make degenerate triangle to continue strip

  vec2 shaft0 = (tip_screen-toward*offset) - perp*offset*0.5;
  clip = ScreenToClip(shaft0);
  gl_Position = vec4(clip.x*tip_clip.w, clip.y*tip_clip.w, tip_clip.z, tip_clip.w);
  EmitVertex();
  EmitVertex();

  vec2 shaft1 = (shaft0-toward*offset);
  clip = ScreenToClip(shaft1);
  gl_Position = vec4(clip.x*tip_clip.w, clip.y*tip_clip.w, tip_clip.z, tip_clip.w);
  EmitVertex();

  vec2 shaft3 = shaft1 + perp*offset;
  vec2 clip3 = ScreenToClip(shaft3);

  vec2 shaft2 = shaft3 + toward*offset;
  vec2 clip2 = ScreenToClip(shaft2);

  gl_Position = vec4(clip2.x*tip_clip.w, clip2.y*tip_clip.w, tip_clip.z, tip_clip.w);
  EmitVertex();
  gl_Position = vec4(clip3.x*tip_clip.w, clip3.y*tip_clip.w, tip_clip.z, tip_clip.w);
  EmitVertex();

  EndPrimitive();
}""",
    PreviewSortOrder=5,
    VertexShader="""#version 330

layout(location = 0) in vec3 vertex;

// pass through shader, all the 'work' will be
// done in the geometry shader
void main() 
{
  gl_Position = vec4(vertex,1.0);
}""",
    glLineWidth=3,
    glPointSize=8)
