# Grasshopper definition post_effects(CSB).gh (Grasshopper 1.0.7)
# plug-ins: ghgl

saturation = Slider(1.145, range=0..5)
brightness = Slider(1.108, range=0..5)
contrast = Slider(1.181, range=0..5)
pt = Point([Point(-1, -1, -1), Point(1, -1, -1), Point(1, 1, -1), Point(-1, 1, -1)])
saturation_scales = ColourRGB(Alpha=255, Red=Slider(48.662, range=0..100), Green=Slider(50, range=0..100), Blue=Slider(45.91, range=0..100))
gl_shader = GLShader(
    Vertex=pt,
    Contrast=contrast,
    Saturation=saturation,
    Brightness=brightness,
    RgbScales=saturation_scales,
    DepthTestingEnabled=True,
    DepthWritingEnabled=True,
    DrawMode=6,
    FragmentShader="""/////////////////////////////////////////////////////////////////////
// Image Contrast, Saturation, and Brightness post-effect for Rhino
// Robert McNeel & Associates (C) - 2019
#version 330

const vec3 Lum = vec3(0.2125, 0.7154, 0.0721);

uniform sampler2D _colorBuffer;
uniform float      Brightness = 1.0;
uniform float      Contrast = 1.0;
uniform float      Saturation = 1.0;
uniform vec4       rgbScales = vec4(0.5);

vec2 bufferSize = textureSize(_colorBuffer, 0);

/////////////////////////////////////////////////////////////////////
vec3 ContrastSaturationBrightness(in vec3 color, 
                                  in float con, 
                                  in float sat, 
                                  in float brt)
{
	vec3 AvgLumin = 1.0-rgbScales.rgb;
	vec3 brtColor = color * brt;
	vec3 intensity = vec3(dot(brtColor, Lum));
	vec3 satColor = mix(intensity, brtColor, sat);

	return mix(AvgLumin, satColor, con);
}

/////////////////////////////////////////////////////////////////////
void ProcessImage(out vec4 fragColor, in vec2 fragCoord, in vec2 uv)
{
  fragColor = texture(_colorBuffer, uv);
  fragColor.rgb = ContrastSaturationBrightness(fragColor.rgb, Contrast, Saturation, Brightness);
}

/////////////////////////////////////////////////////////////////////
out vec4 FragColor;

void main()
{
  vec2 uv = gl_FragCoord.xy / bufferSize;
 
  ProcessImage(FragColor, gl_FragCoord.xy, uv);
}""",
    GLShader=(0, 1, 0),
    VertexShader="""#version 330

layout(location = 0) in vec3 vertex;
out vec2 tc;
void main() 
{
  gl_Position = vec4(vertex,1);
}""",
    glLineWidth=3,
    glPointSize=8)
