# Grasshopper definition post_effects(pixelate).gh (Grasshopper 1.0.7)
# plug-ins: ghgl

pt = Point([Point(-1, -1, -1), Point(1, -1, -1), Point(1, 1, -1), Point(-1, 1, -1)])
gl_shader = GLShader(
    Vertex=pt,
    Horizontal_pos=Slider(0.416, range=0..1),
    Amount=Slider(11.21, range=0..50),
    DepthTestingEnabled=False,
    DepthWritingEnabled=False,
    DrawMode=6,
    FragmentShader="""#version 330 core

uniform sampler2D _colorBuffer;
uniform vec2 _viewportSize;
uniform float horizontal_pos;
uniform float amount;

out vec4 fragment_color;
void main() 
{
  vec2 uv = gl_FragCoord.xy / _viewportSize;

  float t = horizontal_pos;

  fragment_color = texture(_colorBuffer, uv);
  if( amount>0.001 && uv.s < t) {
    float x = uv.s * _viewportSize.x;
    x = x - mod(x,amount) + amount * 0.5;
    x = x / _viewportSize.x;
    float y = uv.t * _viewportSize.y;
    y = y - mod(y,amount) + amount * 0.5;
    y = y / _viewportSize.y;
    vec2 p = vec2(x,y);
    fragment_color = texture(_colorBuffer, p);
  }
}""",
    GLShader=(0, 1, 0),
    VertexShader="""#version 330

layout(location = 0) in vec3 vertex;

void main() {
  gl_Position = vec4(vertex,1);
}""",
    glLineWidth=3,
    glPointSize=8)
