# Grasshopper definition rectangles.gh (Grasshopper 1.0.7)
# plug-ins: ghgl

crv = Curve(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)
dedomain = DeconstructDomain(Domain=crv)  # -> Start, End
size = Slider(92.029, range=1..500)
divide = DivideCurve(Curve=crv, Count=Slider(118, range=0..300), Kinks=False)  # -> Points, Tangents, Parameters
gradient = Gradient(
    LowerLimit=dedomain.Start,
    UpperLimit=dedomain.End,
    Parameter=divide.Parameters,
    stops=[0: RGB(0, 98, 0), 0: RGB(7, 192, 228), 0: RGB(168, 89, 183), 0.25: RGB(81, 175, 17), 0.529: RGB(159, 198, 146), 0.75: RGB(170, 235, 41), 1: RGB(221, 255, 53)])
multiplication = Multiplication(A=size, B=Slider(0.5, range=0.1..2))
gl_shader = GLShader(
    World_vertex=divide.Points,
    Curve_param=divide.Parameters,
    Vertex_color=gradient,
    Pixel_width=size,
    Pixel_height=multiplication,
    Border_width=Slider(4.373, range=0..20),
    Corner_radius=Slider(71.356, range=0..100),
    DepthTestingEnabled=True,
    DepthWritingEnabled=True,
    DrawMode=0,
    FragmentShader="""#version 330

uniform float border_width;
uniform float corner_radius;

flat in vec4 fill_color;
flat in vec2 pixel_size;
in vec2 texture_coordinate;

float Distance()
{
  float tcx = abs(texture_coordinate.x - pixel_size.x * 0.5);
  float tcy = abs(texture_coordinate.y - pixel_size.y * 0.5);
  float border_dist_x = pixel_size.x*0.5 - border_width * 0.5;
  float border_dist_y = pixel_size.y*0.5 - border_width * 0.5;
  float d0 = tcx - border_dist_x;
  float d1 = tcy - border_dist_y;
  float rect_distance = max(d0,d1);
  float corner = pixel_size.y*0.5 * corner_radius*0.01;
  if(tcx>(border_dist_x-corner) && tcy>(border_dist_y-corner))
  {
    float local_tcx = tcx-(border_dist_x-corner);
    float local_tcy = tcy-(border_dist_y-corner);
    vec2 tc_radius = vec2(local_tcx, local_tcy);
    return length(tc_radius) - corner;
  }
  return rect_distance;
}

vec4 outline(float distance, float linewidth, float antialias, vec4 stroke, vec4 fill)
{
  vec4 frag_color;
  float t = linewidth/2.0 - antialias;
  float signed_distance = distance;
  float border_distance = abs(signed_distance) - t;
  float alpha = border_distance/antialias;
  alpha = exp(-alpha*alpha);

  if( border_distance < 0.0 )
    frag_color = stroke;
  else if( signed_distance < 0.0 )
    frag_color = mix(fill, stroke, sqrt(alpha));
  else
    frag_color = vec4(stroke.rgb, stroke.a * alpha);
  return frag_color;
}

void main() {
  float dist = Distance();
  vec4 color = outline(dist, border_width, 0.5, vec4(0,0,0,1), fill_color);
  if( color.a<0.1 )
    discard;
  gl_FragColor = color;
}""",
    GLShader=(0, 1, 0),
    GeometryShader="""#version 330

layout (points) in;
layout (triangle_strip, max_vertices = 4) out;
in vec4 vs_fill_color[];
in float vs_pixel_width[];
in float vs_pixel_height[];

flat out vec4 fill_color;
flat out vec2 pixel_size;
out vec2 texture_coordinate;

uniform vec2 _viewportSize;

void main() {
  fill_color = vs_fill_color[0];
  pixel_size = vec2(vs_pixel_width[0], vs_pixel_height[0]);
  float x = vs_pixel_width[0] / _viewportSize.x;
  float y = vs_pixel_height[0] / _viewportSize.y;
  texture_coordinate = vec2(0,0);
  vec4 pos = gl_in[0].gl_Position;
  pos.x = pos.x / pos.w;
  pos.y = pos.y / pos.w;
  pos.z = pos.z / pos.w;
  pos.w = 1.0;
  gl_Position = pos + vec4(-x, -y, 0.0, 0.0); 
  EmitVertex();

  texture_coordinate.x = vs_pixel_width[0];
  texture_coordinate.y = 0;
  gl_Position = pos + vec4(x, -y, 0.0, 0.0); 
  EmitVertex();

  texture_coordinate.x = 0;
  texture_coordinate.y = vs_pixel_height[0];
  gl_Position = pos + vec4(-x, y, 0.0, 0.0); 
  EmitVertex();

  texture_coordinate.x = vs_pixel_width[0];
  texture_coordinate.y = vs_pixel_height[0];
  gl_Position = pos + vec4(x, y, 0.0, 0.0);
  EmitVertex();
  EndPrimitive();
}  """,
    PreviewSortOrder=5,
    VertexShader="""#version 330

layout(location = 0) in vec3 world_vertex;
layout(location = 1) in float curve_param;
layout(location = 2) in vec4 vertex_color;

uniform mat4 _worldToClip;
uniform vec2 _viewportSize;
uniform float pixel_width;
uniform float pixel_height;

out vec4 vs_fill_color;
out float vs_pixel_width;
out float vs_pixel_height;
void main() {
  vec4 vertex = _worldToClip * vec4(world_vertex,1.0);
  // center points on pixels so they get drawn as 'clean' as possible
  vertex.x = (int(vertex.x/vertex.w*_viewportSize.x)+0.5) / _viewportSize.x * vertex.w;
  vertex.y = (int(vertex.y/vertex.w*_viewportSize.y)+0.5) / _viewportSize.y * vertex.w;

  vs_fill_color = vertex_color;
  gl_Position = vertex;
  vs_pixel_width = pixel_width;
  vs_pixel_height = pixel_height;
}""",
    glLineWidth=3,
    glPointSize=8)
