# Grasshopper definition sorted_curves.gh (Grasshopper 1.0.7)
# plug-ins: ghgl

C = Curve(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)
C_2 = Curve([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])
C_3 = Curve(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)
len = Length(Curve=C_2)
divide = DivideCurve(Curve=C, Count=Slider(264, range=0..500), Kinks=False)  # -> Points, Tangents, Parameters
col = Colour(RGBA(193, 63, 255, 81))
divide_2 = DivideCurve(Curve=C_2, Count=Slider(264, range=0..500), Kinks=False)  # -> Points, Tangents, Parameters
divide_3 = DivideCurve(Curve=C_3, Count=Slider(264, range=0..500), Kinks=False)  # -> Points, Tangents, Parameters
col_2 = Colour(RGB(48, 244, 93))
multiplication = Multiplication(A=len, B=Slider(5.46, range=0..10))
rgb = ColourRGB(Alpha=255, Red=0, Green=multiplication, Blue=multiplication)
gl_shader = GLShader(
    Vertex=divide.Points,
    Vcolor=col,
    DepthTestingEnabled=True,
    DepthWritingEnabled=True,
    DrawMode=3,
    FragmentShader="""#version 330

in vec4 vertex_color;

void main()
{
  gl_FragColor = vertex_color;
}""",
    GLShader=(0, 1, 0),
    PreviewSortOrder=2,
    VertexShader="""#version 330

layout(location = 0) in vec3 vertex;
uniform vec4 vcolor;
uniform mat4 _worldToClip;
out vec4 vertex_color;

void main() 
{
  vertex_color = vcolor;
  gl_Position = _worldToClip * vec4(vertex,1.0);
}""",
    glLineWidth=15,
    glPointSize=8)
gl_shader_2 = GLShader(
    Vertex=divide_3.Points,
    Vcolor=col_2,
    DepthTestingEnabled=True,
    DepthWritingEnabled=True,
    DrawMode=3,
    FragmentShader="""#version 330

in vec4 vertex_color;

void main()
{
  gl_FragColor = vertex_color;
}""",
    GLShader=(0, 1, 0),
    PreviewSortOrder=3,
    VertexShader="""#version 330

layout(location = 0) in vec3 vertex;
uniform vec4 vcolor;
uniform mat4 _worldToClip;
out vec4 vertex_color;

void main() 
{
  vertex_color = vcolor;
  gl_Position = _worldToClip * vec4(vertex,1);
}""",
    glLineWidth=3,
    glPointSize=8)
gl_shader_3 = GLShader(
    Vertex=divide_2.Points,
    Vcolor=rgb,
    DepthTestingEnabled=True,
    DepthWritingEnabled=True,
    DrawMode=3,
    FragmentShader="""#version 330

in vec4 vertex_color;

void main()
{
  gl_FragColor = vertex_color;
}""",
    GLShader=(0, 1, 0),
    PreviewSortOrder=1,
    VertexShader="""#version 330

layout(location = 0) in vec3 vertex;
uniform vec4 vcolor;
uniform mat4 _worldToClip;
out vec4 vertex_color;

void main() 
{
  vertex_color = vcolor;
  gl_Position = _worldToClip * vec4(vertex,1.0);
}""",
    glLineWidth=1,
    glPointSize=8)
