# Grasshopper definition sprite.gh (Grasshopper 1.0.7)
# plug-ins: MacawGH, ghgl

num = Number(200)
textures = TexturePresets(Mode=0, X=5, Y=10)
generate = GenerateTexture(Texture=textures, Width=num, Height=num)
mesh = Mesh(<mesh referenced from the Rhino model>)
path = FilePath("C:\dev\github\mcneel\ghgl\tests\quito_graffiti.jpg")
rgb = ColourRGB(Alpha=255, Red=Slider(213, range=0..255), Green=0, Blue=0)
pt = Point([Point(6.935575539, -25.83025608, 0), Point(-13.14240077, -11.90219154, 0), Point(-25.91677649, 17.10483593, 0), Point(-10.04046676, 35.11742841, 0), Point(28.53692807, 0, 0), Point(31.53217559, -17.63675876, 0)])
gl_shader = GLShader(
    World_vertex=pt,
    Vertex_color=rgb,
    Radius=Slider(3, range=1..1050),
    Image=generate,
    World_size=Toggle(True),
    DrawMode=0,
    FragmentShader="""#version 330 core

uniform sampler2D image;
flat in vec4 border_color;
in vec2 texture_coordinate;

out vec4 fragment_color;
void main() 
{
  vec4 color = texture(image, texture_coordinate);

  vec2 t = texture_coordinate - vec2(0.5,0.5);
  t.xy *= 2.0;
  fragment_color = color;
  if( length(t)>0.9 )
    fragment_color = border_color;
  if( length(t)>1.0 )
    discard;
}""",
    GLShader=(0, 1, 0),
    GeometryShader="""#version 330 core

layout(points) in;
layout(triangle_strip, max_vertices = 4) out;
uniform vec2 _viewportSize;
uniform float radius;
uniform int world_size;
uniform mat4 _worldToClip;
uniform mat4 _worldToCamera;
uniform mat4 _cameraToClip;

in vec4 color[];

flat out vec4 border_color;
out vec2 texture_coordinate;

vec2 ClipToScreen(in vec4 clip)
{
  float x = _viewportSize.x * (1.0f + clip.x / clip.w) * 0.5f;
  float y = _viewportSize.y * (1.0f + clip.y / clip.w) * 0.5f;
  return vec2(x, y);
}

vec4 ScreenToClip(in float screenx, in float screeny, in float z, in float w)
{
  float x = 2.0f * screenx / _viewportSize.x - 1.0f;
  float y = 2.0f * screeny / _viewportSize.y - 1.0f;
  return vec4(x * w, y * w, z, w);
}

void Emit(vec4 v)
{
  gl_Position = v;
  EmitVertex();
}

void main()
{
  border_color = color[0];

  if(world_size==1)
  {
    vec4 center =  _worldToCamera * gl_in[0].gl_Position;
    
    texture_coordinate = vec2(0.0,1.0);
    vec4 corner = _cameraToClip * vec4(center.x-radius, center.y-radius, center.z, 1);
    Emit(corner);
    texture_coordinate = vec2(1.0,1.0);
    corner = _cameraToClip * vec4(center.x+radius, center.y-radius, center.z, 1);
    Emit(corner);
    texture_coordinate = vec2(0.0,0.0);
    corner = _cameraToClip * vec4(center.x-radius, center.y+radius, center.z, 1);
    Emit(corner);
    texture_coordinate = vec2(1.0,0.0);
    corner = _cameraToClip * vec4(center.x+radius, center.y+radius, center.z, 1);
    Emit(corner);
  }
  else
  {
    vec4 clip = _worldToClip * gl_in[0].gl_Position;
    vec2 screen = ClipToScreen(clip);

    vec2 center = screen;

    texture_coordinate = vec2(0.0,1.0);
    vec2 screen0 = screen + vec2(-radius, -radius);
    vec4 corner = ScreenToClip(screen0.x, screen0.y,clip.z,clip.w);
    Emit(corner);

    texture_coordinate = vec2(1.0,1.0);
    vec2 screen1 = screen + vec2(radius, -radius);
    corner = ScreenToClip(screen1.x, screen1.y,clip.z,clip.w);
    Emit(corner);

    texture_coordinate = vec2(0.0,0.0);
    vec2 screen2 = screen + vec2(-radius, radius);
    corner = ScreenToClip(screen2.x, screen2.y,clip.z,clip.w);
    Emit(corner);

    texture_coordinate = vec2(1.0,0.0);
    vec2 screen3 = screen + vec2(radius, radius);
    corner = ScreenToClip(screen3.x, screen3.y,clip.z,clip.w);
    Emit(corner);
  }
  EndPrimitive();
}""",
    VertexShader="""#version 330

layout(location = 0) in vec3 world_vertex;
layout(location = 1) in vec4 vertex_color;

out vec4 color;

void main() {
  gl_Position = vec4(world_vertex,1);
  color = vertex_color;
}""",
    glLineWidth=3,
    glPointSize=8)
gl_mesh = GLMeshShader(
    M=mesh,
    Image=generate,
    DrawMode=4,
    FragmentShader="""#version 330

uniform mat3 _worldToCameraNormal;
uniform sampler2D image;

in  vec2 tc;
out vec4 FragColor;

void main()
{
  vec4 color = texture(image, tc);

  FragColor = color;
}""",
    GLShader=(0, 1, 0),
    VertexShader="""#version 330

layout(location = 0) in vec3 _meshVertex;
layout(location = 1) in vec3 _meshNormal;
layout(location = 2) in vec2 _meshTextureCoordinate;

uniform mat4 _worldToClip;
out vec2 tc;

void main() 
{
  tc = _meshTextureCoordinate;
  gl_Position = _worldToClip * vec4(_meshVertex,1);
}""",
    glLineWidth=3,
    glPointSize=8)
