# Grasshopper definition symbols.gh (Grasshopper 1.0.4)
# plug-ins: ghgl

crv = Curve(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)
dedomain = DeconstructDomain(Domain=crv)  # -> Start, End
divide = DivideCurve(Curve=crv, Count=Slider(423, range=0..3000), Kinks=False)  # -> Points, Tangents, Parameters
gradient = Gradient(
    LowerLimit=dedomain.Start,
    UpperLimit=dedomain.End,
    Parameter=divide.Parameters,
    stops=[0: RGB(0, 98, 0), 0: RGB(7, 192, 228), 0: RGB(168, 89, 183), 0.25: RGB(81, 175, 17), 0.5: RGB(159, 198, 146), 0.75: RGB(170, 235, 41), 1: RGB(221, 255, 53)])
gl_shader = GLShader(
    world_vertex=divide.Points,
    curve_param=divide.Parameters,
    vertex_color=gradient,
    radius=Slider(14, range=1..50),
    style=Slider(7, range=0..11),
    DrawMode=0,
    FragmentShader="""#version 330 core

const float PI = 3.14159265358979323846264;
const float SQRT_2 = 1.4142135623730951;
const float MIN_INNER = 0.001;

in block
{
  flat vec4  stroke_color;
  flat vec4  fill_color;
  flat float linewidth;
  flat float diameter;
  flat float inner_diameter;
  flat int style;
  flat float full_diameter;
  vec2 texture_coordinate;
} In;

out vec4 fragment_color;

vec4 outline(float distance, float linewidth, float antialias, vec4 stroke, vec4 fill)
{
  vec4 frag_color;
  float t = linewidth/2.0 - antialias;
  float signed_distance = distance;
  float border_distance = abs(signed_distance) - t;
  float alpha = border_distance/antialias;
  alpha = exp(-alpha*alpha);

  if( border_distance < 0.0 )
    frag_color = stroke;
  else if( signed_distance < 0.0 )
    frag_color = mix(fill, stroke, sqrt(alpha));
  else
    frag_color = vec4(stroke.rgb, stroke.a * alpha);
  return frag_color;
}

float disc(vec2 P, float size, float inner_size)
{
  float r1 = length(P) - size * 0.5;
  if( inner_size<MIN_INNER )
    return r1;
  float r2 = length(P) - inner_size * 0.5;
  return max(r1,-r2);
}

float square(vec2 P, float size, float inner_size)
{
  float r1 = max(abs(P.x), abs(P.y)) - size/(2*SQRT_2);
  if( inner_size<MIN_INNER )
    return r1;
  float r2 = max(abs(P.x), abs(P.y)) - inner_size/(2*SQRT_2);
  return max(r1,-r2);
}

float triangle(vec2 P, float size)
{
  float x = SQRT_2/2 * (P.x*2 - P.y);
  float y = SQRT_2/2 * (P.x*2 + P.y);
  float r1 = max(abs(x), abs(y)) - size/(2*SQRT_2);
  float r2 = P.y;
  return max(r1,r2);
}

float heart(vec2 P, float size)
{
  float x = SQRT_2/2.0 * (P.x - P.y);
  float y = SQRT_2/2.0 * (P.x + P.y);
  float r1 = max(abs(x),abs(y))-size/3.5;
  float r2 = length(P - SQRT_2/2.0*vec2(+1.0,-1.0)*size/3.5) - size/3.5;
  float r3 = length(P - SQRT_2/2.0*vec2(-1.0,-1.0)*size/3.5) - size/3.5;
  return min(min(r1,r2),r3);
}

float chevron(vec2 P, float size)
{
  float x = 1/SQRT_2 * (P.x - P.y);
  float y = 1/SQRT_2 * (P.x + P.y);
  float r1 = max(abs(x),        abs(y))        - size/3;
  float r2 = max(abs(x-size/3), abs(y-size/3)) - size/3;
  return max(r1,-r2);
}

float clover(vec2 P, float size)
{
  const float t1 = -PI/2;
  const vec2  c1 = 0.25*vec2(cos(t1),sin(t1));
  const float t2 = t1+2*PI/3;
  const vec2  c2 = 0.25*vec2(cos(t2),sin(t2));
  const float t3 = t2+2*PI/3;
  const vec2  c3 = 0.25*vec2(cos(t3),sin(t3));

  float r1 = length( P - c1*size) - size/3.5;
  float r2 = length( P - c2*size) - size/3.5;
  float r3 = length( P - c3*size) - size/3.5;
  return min(min(r1,r2),r3);
}

float tag(vec2 P, float size)
{
  float r1 = max(abs(P.x)- size/2, abs(P.y)- size/6);
  float r2 = abs(P.x-size/1.5)+abs(P.y)-size;
  return max(r1,.75*r2);
}

float cross(vec2 P, float size)
{
  float x = SQRT_2/2 * (P.x - P.y);
  float y = SQRT_2/2 * (P.x + P.y);
  float r1 = max(abs(x - size/3), abs(x + size/3));
  float r2 = max(abs(y - size/3), abs(y + size/3));
  float r3 = max(abs(x), abs(y));
  float r = max(min(r1,r2),r3);
  r -= size/2;
  return r;
}

float asterisk(vec2 P, float size)
{
  float x = SQRT_2/2 * (P.x - P.y);
  float y = SQRT_2/2 * (P.x + P.y);
  float r1 = max(abs(x)- size/2, abs(y)- size/10);
  float r2 = max(abs(y)- size/2, abs(x)- size/10);
  float r3 = max(abs(P.x)- size/2, abs(P.y)- size/10);
  float r4 = max(abs(P.y)- size/2, abs(P.x)- size/10);
  return min( min(r1,r2), min(r3,r4));
}

float pin(vec2 P, float size, float inner_size)
{
  vec2 c1 = vec2(0.0,-0.15)*size;
  float r1 = length(P-c1)-size/2.675;
  vec2 c2 = vec2(+1.49,-0.80)*size;
  float r2 = length(P-c2) - 2.*size;
  vec2 c3 = vec2(-1.49,-0.80)*size;
  float r3 = length(P-c3) - 2.*size;
  if( inner_size<MIN_INNER)
    return min(r1,max(max(r2,r3),-P.y));
  float r4 = length(P-c1)-inner_size * 0.4;
  return max( min(r1,max(max(r2,r3),-P.y)), -r4);
}

float arrow(vec2 P, float size)
{
  P.x = -P.x;
  float r1 = abs(P.x) + abs(P.y*1.25) - size/2;
  float r2 = max(abs(P.x+size/2), abs(P.y)) - size/2;
  //float r3 = max(abs(P.x-size/6)-size/4, abs(P.y)- size/4);
  // skinny up the tail
  float r3 = max(abs(P.x-size/6)-size/3, abs(P.y)- size/6);
  return min(r3,max(.75*r1,r2));
}

float linearstep(float lo, float hi, float x)
{
  return (clamp(x, lo, hi) - lo) / (hi - lo);
}

float DistToLine(vec2 pt1, vec2 pt2, vec2 testPt)
{
  vec2 lineDir = pt2 - pt1;
  vec2 perpDir = vec2(lineDir.y, -lineDir.x);
  vec2 dirToPt1 = pt1 - testPt;
  return abs(dot(normalize(perpDir), dirToPt1));
}

const int SQUARE   = 0;
const int CIRCLE   = 1;
const int TRIANGLE = 2;
const int HEART    = 3;
const int CHEVRON  = 4;
const int CLOVER   = 5;
const int TAG      = 6;
const int CROSS    = 7;
const int ASTERISK = 8;
const int PIN      = 9;
const int ARROWTAIL= 10;
const int ARROWTIP = 11;

const int VARIABLE_DOT = 50;
const int ROUND_DOT = 51;

// "POINT's" are border filled color with white centers, 2 color entities...
// Note: The radius can vary on all of these...
const int CONTROL_POINT = 100;
const int ACTIVE_POINT  = 101;
const int ROUND_CONTROL_POINT = 102;
const int ROUND_ACTIVE_POINT = 103;

void main() 
{
  int style = In.style;
  vec4 color = vec4(0);

  if( style>99 )
  {
    vec2 centered = abs(In.texture_coordinate);
    vec4 fill_color = In.fill_color;
    float full_radius = In.full_diameter * 0.5;
    float base_diameter = In.diameter;
    float normalized_blend = 0.5 / full_radius;
    float radius = base_diameter * 0.5;
    float border_width = log2(radius)-0.5;
    if (border_width < 1.0f)
      border_width = 1.0f;
    border_width = floor(border_width);
    float border_start = radius - border_width;

    float normalized_border_start = border_start / full_radius;
    float normalized_border_end = (border_start + border_width) / full_radius;

    if (ROUND_CONTROL_POINT == style || ROUND_ACTIVE_POINT == style)
    {
      // this should handle basic, and control point styles
      float l = length(centered)*2.0;
      if (l > normalized_border_end - normalized_blend)
      {
        color = In.stroke_color;
        color.a = mix(1, 0, linearstep(normalized_border_end - normalized_blend, normalized_border_end + normalized_blend, l));
      }
      else
      {
        color = mix(fill_color, In.stroke_color, linearstep(normalized_border_start - normalized_blend, normalized_border_start + normalized_blend, l));
      }
    }
    else
    {
      if (2 * centered.x < normalized_border_start && 2 * centered.y < normalized_border_start)
        color = fill_color;
      else if (2 * centered.x > normalized_border_end || 2 * centered.y > normalized_border_end)
        color = vec4(0);
      else
        color = In.stroke_color;
    }

    // draw cross hairs for active control points
    if (ACTIVE_POINT == style || ROUND_ACTIVE_POINT == style)
    {
      float half_thickness = border_width * 0.5 / In.full_diameter;
      if (centered.x <= half_thickness || centered.y <= half_thickness)
        color = In.stroke_color;
    }
  }
  else
  {
    vec2 P = In.texture_coordinate;
    float point_size = In.full_diameter;
    float diameter = In.diameter;

    float distance = 1;  
    if( style==SQUARE || style==CONTROL_POINT || style==ACTIVE_POINT )
      distance = square(P*point_size, diameter, In.inner_diameter);
    else if( style==CIRCLE || style==ROUND_CONTROL_POINT || style==ROUND_ACTIVE_POINT )
      distance = disc(P*point_size, diameter, In.inner_diameter);
    else if( style==TRIANGLE )
      distance = triangle(P*point_size, diameter);
    else if( style==HEART )
      distance = heart(P*point_size, diameter);
    else if( style==CHEVRON )
      distance = chevron(P*point_size, diameter);
    else if( style==CLOVER )
      distance = clover(P*point_size, diameter);
    else if( style==TAG )
      distance = tag(P*point_size, diameter);
    else if( style==CROSS )
      distance = cross(P*point_size, diameter);
    else if( style==ASTERISK )
      distance = asterisk(P*point_size, diameter);
    else if( style==PIN )
      distance = pin(P*point_size, diameter, In.inner_diameter);
    else if( style==ARROWTAIL || style==ARROWTIP )
      distance = arrow(P*point_size, diameter);

    const float antialias = 0.5;
    color = outline(distance, In.linewidth, antialias, In.stroke_color, In.fill_color);
  }

  if( color.a < 0.1 )
    discard;
  fragment_color = color;
}""",
    GeometryShader="""#version 330 core
layout (std140) uniform;

layout(points) in;
layout(triangle_strip, max_vertices = 4) out;
uniform vec2 _viewportSize;

in block
{
  vec4  stroke_color;
  vec4  fill_color;
  float linewidth;
  float diameter;
  float inner_diameter;
  float rotation;
  int style;
  float full_diameter;
} In[];

out block
{
  flat vec4  stroke_color;
  flat vec4  fill_color;
  flat float linewidth;
  flat float diameter;
  flat float inner_diameter;
  flat int style;
  flat float full_diameter;
  vec2 texture_coordinate;
} Out;

vec2 ClipToScreen(in vec4 clip)
{
  float x = _viewportSize.x * (1.0f + clip.x / clip.w) * 0.5f;
  float y = _viewportSize.y * (1.0f + clip.y / clip.w) * 0.5f;
  return vec2(x, y);
}

vec4 ScreenToClip(in float screenx, in float screeny, in float z, in float w)
{
  float x = 2.0f * screenx / _viewportSize.x - 1.0f;
  float y = 2.0f * screeny / _viewportSize.y - 1.0f;
  return vec4(x * w, y * w, z, w);
}

vec2 RotatePoint(in vec2 p, in float angle, in vec2 center)
{
  float s = sin(angle);
  float c = cos(angle);

  // translate point back to origin:
  p = p - center;

  // rotate point
  float xnew = p.x * c - p.y * s;
  float ynew = p.x * s + p.y * c;

  // translate point back:
  p.x = xnew + center.x;
  p.y = ynew + center.y;
  return p;
}

void Emit(vec4 v)
{
  gl_Position = v;
  EmitVertex();
}

const int PIN = 9;
const int ARROW_TAIL = 10;
const int ARROW_TIP = 11;

void main()
{
  Out.stroke_color = In[0].stroke_color;
  Out.fill_color = In[0].fill_color;
  Out.linewidth = In[0].linewidth;
  Out.diameter = In[0].diameter;
  Out.inner_diameter = In[0].inner_diameter;
  Out.style = In[0].style;
  Out.full_diameter = In[0].full_diameter;

  vec4 clip = gl_in[0].gl_Position;
  //if( abs(clip.z)<1.01 )
  {
    vec2 screen = ClipToScreen(clip);
    float radius = In[0].full_diameter * 0.5;

    vec2 center = screen;
    if( In[0].style==PIN )
    {
      screen.y += In[0].diameter * 0.5 + In[0].linewidth;
    }
    if( In[0].style==ARROW_TAIL )
    {
      screen.x += In[0].diameter * 0.5;
      screen.x += In[0].inner_diameter;
    }
    if( In[0].style==ARROW_TIP )
    {
      screen.x -= In[0].diameter * 0.5;
      screen.x -= In[0].inner_diameter;
    }

    Out.texture_coordinate = vec2(-0.5,0.5);
    vec2 screen0 = screen + vec2(-radius, -radius);
    screen0 = RotatePoint(screen0, In[0].rotation, center);
    vec4 corner = ScreenToClip(screen0.x, screen0.y,clip.z,clip.w);
    Emit(corner);

    Out.texture_coordinate = vec2(0.5,0.5);
    vec2 screen1 = screen + vec2(radius, -radius);
    screen1 = RotatePoint(screen1, In[0].rotation, center);
    corner = ScreenToClip(screen1.x, screen1.y,clip.z,clip.w);
    Emit(corner);

    Out.texture_coordinate = vec2(-0.5,-0.5);
    vec2 screen2 = screen + vec2(-radius, radius);
    screen2 = RotatePoint(screen2, In[0].rotation, center);
    corner = ScreenToClip(screen2.x, screen2.y,clip.z,clip.w);
    Emit(corner);

    Out.texture_coordinate = vec2(0.5,-0.5);
    vec2 screen3 = screen + vec2(radius, radius);
    screen3 = RotatePoint(screen3, In[0].rotation, center);
    corner = ScreenToClip(screen3.x, screen3.y,clip.z,clip.w);
    Emit(corner);
  }
  EndPrimitive();
}""",
    glLineWidth=3,
    glPointSize=8,
    GLShader=(0, 1, 0),
    VertexShader="""#version 330

layout(location = 0) in vec3 world_vertex;
layout(location = 1) in float curve_param;
layout(location = 2) in vec4 vertex_color;

uniform mat4 _worldToClip;
uniform vec2 _viewportSize;
uniform int point_count;
uniform float max_domain;
uniform int style;
uniform int radius;

out block
{
  vec4  stroke_color;
  vec4  fill_color;
  float linewidth;
  float diameter;
  float inner_diameter;
  float rotation;
  int style;
  float full_diameter;
} Out;

const float SQRT_2 = 1.4142135623730951;
const int CONTROL_POINT = 100;
const int ACTIVE_POINT  = 101;
const int ROUND_CONTROL_POINT = 102;
const int ROUND_ACTIVE_POINT = 103;

void main() {
  float diameter = radius * 2.0;
  float stroke_width = diameter * 0.1;

  vec4 clip = _worldToClip * vec4(world_vertex,1);
  // center points on pixels so they get drawn as 'clean' as possible
  clip.x = (int(clip.x*_viewportSize.x)+0.5) / _viewportSize.x;
  clip.y = (int(clip.y*_viewportSize.y)+0.5) /_viewportSize.y;
  gl_Position = clip;

  Out.stroke_color = vec4(0,0,0,1);
  Out.fill_color = vertex_color;
  Out.linewidth = stroke_width;
  Out.diameter = diameter;
  Out.inner_diameter = 0;
  Out.rotation = 0;
  Out.style = style;

  const float antialias = 0.5;
  Out.full_diameter = SQRT_2 * diameter + 2.0 * (stroke_width + 1.5*antialias);
}""")
