# Grasshopper definition ticks.gh (Grasshopper 1.0.7)
# plug-ins: ghgl

C = Curve(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)
dedomain = DeconstructDomain(Domain=C)  # -> Start, End
divide = DivideCurve(Curve=C, Count=Slider(1902, range=0..2000), Kinks=False)  # -> Points, Tangents, Parameters
gradient = Gradient(
    LowerLimit=dedomain.Start,
    UpperLimit=dedomain.End,
    Parameter=divide.Parameters,
    stops=[0: RGB(243, 57, 0), 0.1: RGB(236, 27, 60), 0.2: RGB(210, 0, 118), 0.254: RGB(103, 0, 120), 0.4: RGB(39, 72, 161), 0.5: RGB(1, 192, 229), 0.6: RGB(18, 178, 90), 0.7: RGB(79, 186, 8), 0.8: RGB(220, 237, 32), 0.9: RGB(247, 159, 20), 1: RGB(243, 57, 0)])
multiplication = Multiplication(A=divide.Parameters, B=Slider(23.782, range=1..50))
gl_shader = GLShader(
    Vertex=divide.Points,
    Vcolor=gradient,
    T=multiplication,
    DepthTestingEnabled=True,
    DepthWritingEnabled=True,
    DrawMode=3,
    FragmentShader="""#version 330

in vec4 fragment_color;

void main() {
  gl_FragColor = fragment_color;
}""",
    GLShader=(0, 1, 0),
    GeometryShader="""#version 330
layout(lines) in;
layout(line_strip, max_vertices = 4) out;

uniform vec2 _viewportSize;
uniform mat4 _worldToClip;

in vec4 vertex_color[];
in float vertex_t[];
out vec4 fragment_color;

vec2 ClipToScreen(vec4 clip)
{
  float x = _viewportSize.x * (1.0f + clip.x / clip.w) * 0.5f;
  float y = _viewportSize.y * (1.0f + clip.y / clip.w) * 0.5f;
  return vec2(x, y);
}

vec2 ScreenToClip(vec2 screen)
{
  float x = 2.0f * screen.x / _viewportSize.x - 1.0f;
  float y = 2.0f * screen.y / _viewportSize.y - 1.0f;
  return vec2(x, y);
}

void main()
{
  vec4 start_clip = gl_in[0].gl_Position;
  vec2 start_screen = ClipToScreen(start_clip);

  vec4 end_clip = gl_in[1].gl_Position;
  vec2 end_screen = ClipToScreen(end_clip);

  vec2 toward = normalize(end_screen-start_screen);
  vec3 perp3 = cross(vec3(0,0,1), vec3(toward,0));
  float dist_to_whole = sin(fract(vertex_t[0]));
  if(dist_to_whole>0.5)
    dist_to_whole = 1-dist_to_whole;
  float f = 50*dist_to_whole;
  vec2 perp = normalize(vec2(perp3.x,perp3.y)) * f;

  vec2 screen = start_screen + perp;
  vec2 clip = ScreenToClip(screen);
  fragment_color = vertex_color[0];
  gl_Position = vec4(clip.x*start_clip.w, clip.y*start_clip.w, start_clip.z, start_clip.w);
  EmitVertex();

  screen = start_screen - perp;
  clip = ScreenToClip(screen);
  gl_Position = vec4(clip.x*start_clip.w, clip.y*start_clip.w, start_clip.z, start_clip.w);
  EmitVertex();

  gl_Position = gl_in[0].gl_Position;
  fragment_color = vertex_color[0];
  EmitVertex();

  gl_Position = gl_in[1].gl_Position;
  fragment_color = vertex_color[1];
  EmitVertex();
  EndPrimitive();
}""",
    PreviewSortOrder=5,
    VertexShader="""#version 330

layout(location = 0) in vec3 vertex;
layout(location = 1) in vec4 vcolor;
layout(location = 2) in float t;

uniform mat4 _worldToClip;

out vec4 vertex_color;
out float vertex_t;

void main() 
{
  vertex_color = vcolor;
  vertex_t = t;
  gl_Position = _worldToClip * vec4(vertex,1.0);
}""",
    glLineWidth=3,
    glPointSize=8)
