# Grasshopper definition two_sided_material.gh (Grasshopper 1.0.7)
# plug-ins: ghgl

brep = Brep([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])
bbox = BoundingBox(Content=brep, Plane=PlaneXY(0, 0, 0), UnionBox=True)  # -> Box, Box_2
debox = DeconstructBox(Box=bbox.Box)  # -> Plane, X, Y, Z
dedomain = DeconstructDomain(Domain=debox.X)  # -> Start, End
col = Colour(RGB(58, 204, 132))
col_2 = Colour(RGB(234, 45, 255))
gl_mesh = GLMeshShader(
    M=brep,
    XStart=dedomain.Start,
    DiscardGap=Slider(0.38, range=0..1),
    FrontDiffuse=col,
    BackDiffuse=col_2,
    DepthTestingEnabled=True,
    DepthWritingEnabled=True,
    DrawMode=4,
    FragmentShader="""#version 330

uniform vec3 _lightDirection[4];
uniform mat3 _worldToCameraNormal;
uniform float _time;
uniform vec4 frontDiffuse;
uniform vec4 backDiffuse;
uniform float xStart;
uniform float discardGap;

in vec3 normal;
in vec2 xy;

out vec4 fragment_color;

void main() {
  float d = xy.x - xStart + 8.0*sin(xy.y) + _time*1.5;
  if((abs(d-floor(d)))<discardGap)
    discard;
  vec3 l = normalize(_lightDirection[0]);
  vec3 camNormal = _worldToCameraNormal * normal;
  float intensity = dot(l, normalize(camNormal.xyz));
  vec4 diffuse = backDiffuse;
  if (intensity<0.0) {
    diffuse = frontDiffuse;
    intensity = -intensity;
  }

  vec3 ambient = vec3(0.1, 0.1, 0.1) * diffuse.rgb;
  vec3 c = ambient + diffuse.rgb * intensity;
  fragment_color = vec4(c, diffuse.a);
}""",
    GLShader=(0, 1, 0),
    PreviewSortOrder=5,
    VertexShader="""#version 330

layout(location = 0) in vec3 _meshVertex;
layout(location = 1) in vec3 _meshNormal;

uniform mat4 _worldToClip;
out vec3 normal;
out vec2 xy;

void main() {
  normal = _meshNormal;
  xy = _meshVertex.xy;
  gl_Position = _worldToClip * vec4(_meshVertex,1.0);
}""",
    glLineWidth=3,
    glPointSize=8)
