# Grasshopper definition vertex_colors.gh (Grasshopper 1.0.7)
# plug-ins: ghgl

brep = Brep([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])
mesh = Mesh(brep)
mcol = MeshColours(
    Mesh=mesh,
    Colours=[RGB(127, 255, 0), RGB(0, 100, 0), RGB(34, 139, 34), RGB(124, 252, 0), RGB(154, 205, 50), RGB(173, 255, 47), RGB(50, 205, 50), RGB(152, 251, 152)])
gl_mesh = GLMeshShader(
    M=mcol,
    DepthTestingEnabled=True,
    DepthWritingEnabled=True,
    DrawMode=4,
    FragmentShader="""#version 330

uniform vec3 _lightDirection[4];
uniform mat3 _worldToCameraNormal;

in  vec3 normal;
in  vec4 vertexColor;
out vec4 fragment_color;

void main() {
  vec3 l = normalize(_lightDirection[0]);
  vec3 camNormal = _worldToCameraNormal * normal;
  float intensity = dot(l,normalize(camNormal.xyz));
  vec4 diffuse = vec4(1.0, 0.0, 1.0, 1.0);

  vec3 ambient = vec3(0.1, 0.1, 0.1) * diffuse.rgb;
  vec3 c = ambient + diffuse.rgb * abs(intensity);
  vec4 litColor = vec4(c, diffuse.a);
  vec4 mixedColor = mix(litColor, vertexColor, 0.5);
  fragment_color = mixedColor;
}""",
    GLShader=(0, 1, 0),
    PreviewSortOrder=5,
    VertexShader="""#version 330

layout(location = 0) in vec3 _meshVertex;
layout(location = 1) in vec3 _meshNormal;
layout(location = 2) in vec4 _meshVertexColor;

uniform mat4 _worldToClip;
out vec3 normal;
out vec4 vertexColor;

void main() {
  normal = _meshNormal;
  vertexColor = _meshVertexColor;
  gl_Position = _worldToClip * vec4(_meshVertex,1.0);
}""",
    glLineWidth=3,
    glPointSize=8)
