# Grasshopper definition gradient (linear).gh (Grasshopper 1.0.4)
# plug-ins: ghgl

circle = Circle([{Plane=Plane(origin=(0, 1, 0), x=(-0.7071067812, -0.7071067812, 0), y=(0.7071067812, -0.7071067812, 0)), Radius=7.071067812}, {Plane=Plane(origin=(-7, 3, 0), x=(-0.894427191, -0.4472135955, 0), y=(0.4472135955, -0.894427191, 0)), Radius=2.236067977}, {Plane=Plane(origin=(9, -3, 0), x=(-0.8, -0.6, 0), y=(0.6, -0.8, 0)), Radius=5}, {Plane=Plane(origin=(-5, -10, 0), x=(0.316227766, 0.9486832981, 0), y=(-0.9486832981, 0.316227766, 0)), Radius=6.32455532}])
runion = RegionUnion(Curves=circle)
boundary = BoundarySurfaces(Edges=runion)
pt = ConstructPoint(XCoordinate=Slider(-9, range=-30..30), YCoordinate=0, ZCoordinate=0)
pt_2 = Point(Point(11.19222561, -6.402359287, 0))
col = Colour(RGB(40, 236, 153))
col_2 = Colour(RGB(249, 110, 255))
gl_mesh = GLMeshShader(
    M=boundary,
    point0=pt,
    point1=pt_2,
    color0=col,
    color1=col_2,
    DrawMode=4,
    FragmentShader="""#version 330

uniform vec4 color0;
uniform vec4 color1;
in float lineT;

void main()
{
  float t = lineT;
  if(t<0)
    t = 0;
  if(t>1)
    t = 1;
  gl_FragColor =  mix(color0, color1, lineT);
}""",
    glLineWidth=3,
    glPointSize=8,
    GLShader=(0, 1, 0),
    VertexShader="""#version 330

layout(location = 0) in vec3 _meshVertex;

uniform mat4 _worldToClip;
uniform vec3 point0;
uniform vec3 point1;

out float lineT;

// return closest point to line
float ClosestPointToLine(in vec3 point, in vec3 lineFrom, in vec3 lineTo)
{
  vec3 D = lineTo - lineFrom;
  float DoD = D.x*D.x + D.y*D.y + D.z*D.z;
  float t = 0.0;
  if ( DoD > 0.0 ) {
    if( distance(point, lineFrom) <= distance(point, lineTo) ) {
      t = dot((point-lineFrom), D) / DoD;
    }
    else {
      t = 1.0 + dot((point-lineTo), D) / DoD;
    }
  }
  return t;
}

void main() 
{
  lineT = ClosestPointToLine(_meshVertex, point0, point1);
  gl_Position = _worldToClip * vec4(_meshVertex,1);
}""")
