# Grasshopper definition gradient (radial).gh (Grasshopper 1.0.4)
# plug-ins: ghgl

circle = Circle([{Plane=Plane(origin=(0, 1, 0), x=(-0.7071067812, -0.7071067812, 0), y=(0.7071067812, -0.7071067812, 0)), Radius=7.071067812}, {Plane=Plane(origin=(-7, 3, 0), x=(-0.894427191, -0.4472135955, 0), y=(0.4472135955, -0.894427191, 0)), Radius=2.236067977}, {Plane=Plane(origin=(9, -3, 0), x=(-0.8, -0.6, 0), y=(0.6, -0.8, 0)), Radius=5}, {Plane=Plane(origin=(-5, -10, 0), x=(0.316227766, 0.9486832981, 0), y=(-0.9486832981, 0.316227766, 0)), Radius=6.32455532}])
runion = RegionUnion(Curves=circle)
boundary = BoundarySurfaces(Edges=runion)
pt = ConstructPoint(XCoordinate=Slider(-14, range=-30..30), YCoordinate=0, ZCoordinate=0)
pt_2 = Point(Point(11.19222561, -6.402359287, 0))
col = Colour(RGB(40, 236, 153))
col_2 = Colour(RGB(249, 110, 255))
gl_mesh = GLMeshShader(
    M=boundary,
    point0=pt,
    point1=pt_2,
    color0=col,
    color1=col_2,
    DrawMode=4,
    FragmentShader="""#version 330

uniform vec3 point0;
uniform vec3 point1;
uniform vec4 color0;
uniform vec4 color1;
in vec3 vertex;

void main()
{
  vec3 center = point0;
  float totalDistance = distance(point1,center);
  float distanceToCenter = distance(vertex,center);
  float t = distanceToCenter / totalDistance;

  if(t<0)
    t = 0;
  if(t>1)
    t = 1;
  vec4 color = mix(color0, color1, t);
  gl_FragColor = color;
}""",
    glLineWidth=3,
    glPointSize=8,
    GLShader=(0, 1, 0),
    VertexShader="""#version 330

layout(location = 0) in vec3 _meshVertex;

uniform mat4 _worldToClip;

out vec3 vertex;

void main() 
{
  vertex = _meshVertex;
  gl_Position = _worldToClip * vec4(_meshVertex,1);
}""")
