# Grasshopper definition mesh_normals.gh (Grasshopper 1.0.4)
# plug-ins: ghgl

brep = Brep([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])
move = Move(Geometry=brep, Motion=Vector(0, 15, 0))  # -> Geometry, Transform
move_2 = Move(Geometry=brep, Motion=Vector(0, 30, 0))  # -> Geometry, Transform
path = FilePath("C:\dev\github\mcneel\ghgl\tests\quito_graffiti.jpg")
texture_mesh = GLMeshShader(
    Mesh=move_2.Geometry,
    GLMesh=path,
    DrawMode=4,
    FragmentShader="""#version 330

uniform sampler2D image;

in vec2 tc;
void main()
{
  vec4 color = texture(image, tc);
  gl_FragColor = color;
}""",
    glLineWidth=3,
    glPointSize=8,
    GLShader=(0, 1, 0),
    VertexShader="""#version 330

layout(location = 0) in vec3 _meshVertex;
layout(location = 1) in vec2 _meshTextureCoordinate;

uniform mat4 _worldToClip;
out vec2 tc;

void main() 
{
  tc = _meshTextureCoordinate;
  gl_Position = _worldToClip * vec4(_meshVertex,1);
}""")
points_mesh = GLMeshShader(
    Mesh=brep,
    DrawMode=0,
    FragmentShader="""#version 330

in vec4 color;
void main()
{
  gl_FragColor = color;
}""",
    glLineWidth=1,
    glPointSize=4,
    GLShader=(0, 1, 0),
    VertexShader="""#version 330

layout(location = 0) in vec3 _meshVertex;
layout(location = 1) in vec3 _meshNormal;

uniform mat4 _worldToClip;
out vec4 color;

void main() 
{
  color = vec4(_meshNormal, 1);
  gl_Position = _worldToClip * vec4(_meshVertex,1);
}""")
normals_mesh = GLMeshShader(
    Mesh=move.Geometry,
    DrawMode=4,
    FragmentShader="""#version 330

in vec4 color;
void main()
{
  gl_FragColor = color;
}""",
    glLineWidth=3,
    glPointSize=8,
    GLShader=(0, 1, 0),
    VertexShader="""#version 330

layout(location = 0) in vec3 _meshVertex;
layout(location = 1) in vec3 _meshNormal;

uniform mat4 _worldToClip;
out vec4 color;

void main() 
{
  color = vec4(_meshNormal, 1);
  gl_Position = _worldToClip * vec4(_meshVertex,1);
}""")
