# Grasshopper definition mesh_toon.gh (Grasshopper 1.0.4)
# plug-ins: ghgl

col = Colour(RGB(48, 230, 255))
brep = Brep([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])
gl_mesh = GLMeshShader(
    M=brep,
    materialColor=col,
    divs=Slider(5.41, range=1..30),
    DrawMode=4,
    FragmentShader="""#version 330

uniform vec3 _light1Direction;
uniform vec4 materialColor;
uniform float divs;

in vec3 normal;
void main()
{
  vec3 l = normalize(_light1Direction);
  
  float intensity = dot(l,normalize(normal));
  int i = int(intensity*divs);
  intensity = float(i/divs);

  vec3 ambient = vec3(0.2,0.2,0.2) * materialColor.rgb;
  vec3 c = ambient + materialColor.rgb * intensity;
  gl_FragColor = vec4(c, materialColor.a);
}""",
    glLineWidth=3,
    glPointSize=8,
    GLShader=(0, 1, 0),
    VertexShader="""#version 330

layout(location = 0) in vec3 _meshVertex;
layout(location = 1) in vec3 _meshNormal;

uniform mat4 _worldToClip;
out vec3 normal;

void main() 
{
  normal = normalize(_meshNormal);
  gl_Position = _worldToClip * vec4(_meshVertex,1);
}""")
