# Grasshopper definition sprite.gh (Grasshopper 1.0.4)
# plug-ins: ghgl

path = FilePath("C:\dev\github\mcneel\ghgl\tests\quito_graffiti.jpg")
rgb = ColourRGB(Alpha=255, Red=Slider(213, range=0..255), Green=0, Blue=0)
pt = Point([Point(6.935575539, -25.83025608, 0), Point(-13.14240077, -11.90219154, 0), Point(-25.91677649, 17.10483593, 0), Point(-10.04046676, 35.11742841, 0), Point(28.53692807, 0, 0), Point(31.53217559, -17.63675876, 0)])
gl_shader = GLShader(
    world_vertex=pt,
    vertex_color=rgb,
    radius=Slider(47, range=1..1050),
    image=path,
    DrawMode=0,
    FragmentShader="""#version 330 core

uniform sampler2D image;
in block
{
  flat vec4 fill_color;
  vec2 texture_coordinate;
} In;

out vec4 fragment_color;
void main() 
{
  vec4 color = texture(image, In.texture_coordinate);

  vec2 t = In.texture_coordinate - vec2(0.5,0.5);
  t.xy *= 2.0;
  fragment_color = color;
  if( length(t)>0.9 )
    fragment_color = In.fill_color;
  if( length(t)>1.0 )
    discard;
}""",
    GeometryShader="""#version 330 core

layout(points) in;
layout(triangle_strip, max_vertices = 4) out;
uniform vec2 _viewportSize;
uniform int radius;

in vec4 fill_color[];

out block
{
  flat vec4 fill_color;
  vec2 texture_coordinate;
} Out;

vec2 ClipToScreen(in vec4 clip)
{
  float x = _viewportSize.x * (1.0f + clip.x / clip.w) * 0.5f;
  float y = _viewportSize.y * (1.0f + clip.y / clip.w) * 0.5f;
  return vec2(x, y);
}

vec4 ScreenToClip(in float screenx, in float screeny, in float z, in float w)
{
  float x = 2.0f * screenx / _viewportSize.x - 1.0f;
  float y = 2.0f * screeny / _viewportSize.y - 1.0f;
  return vec4(x * w, y * w, z, w);
}

void Emit(vec4 v)
{
  gl_Position = v;
  EmitVertex();
}

void main()
{
  Out.fill_color = fill_color[0];

  vec4 clip = gl_in[0].gl_Position;
  {
    vec2 screen = ClipToScreen(clip);
    float fradius = float(radius);

    vec2 center = screen;

    Out.texture_coordinate = vec2(0.0,1.0);
    vec2 screen0 = screen + vec2(-fradius, -fradius);
    vec4 corner = ScreenToClip(screen0.x, screen0.y,clip.z,clip.w);
    Emit(corner);

    Out.texture_coordinate = vec2(1.0,1.0);
    vec2 screen1 = screen + vec2(fradius, -fradius);
    corner = ScreenToClip(screen1.x, screen1.y,clip.z,clip.w);
    Emit(corner);

    Out.texture_coordinate = vec2(0.0,0.0);
    vec2 screen2 = screen + vec2(-fradius, fradius);
    corner = ScreenToClip(screen2.x, screen2.y,clip.z,clip.w);
    Emit(corner);

    Out.texture_coordinate = vec2(1.0,0.0);
    vec2 screen3 = screen + vec2(fradius, fradius);
    corner = ScreenToClip(screen3.x, screen3.y,clip.z,clip.w);
    Emit(corner);
  }
  EndPrimitive();
}""",
    glLineWidth=3,
    glPointSize=8,
    GLShader=(0, 1, 0),
    VertexShader="""#version 330

layout(location = 0) in vec3 world_vertex;
layout(location = 1) in vec4 vertex_color;

uniform mat4 _worldToClip;

out vec4 fill_color;

void main() {
  vec4 clip = _worldToClip * vec4(world_vertex,1);
  gl_Position = clip;
  fill_color = vertex_color;
}""")
